# Grasshopper definition Interface.gh (Grasshopper 1.0.7)
# plug-ins: Human UI, Kangaroo2 Components

print_progress = Slider(1, range=0..1)
create_toggle = CreateToggle(Default=False, Label="Optimize Print Path", OnLabel="on", OffLabel="off")
create_toggle_2 = CreateToggle(Default=False, Label="Preview Print Path", OnLabel="on", OffLabel="off")
create_label = CreateLabel(LabelText="Step 3 :  Preview Printing", LabelSize=12, Justification=0)
create_slider = CreateSlider(Slider=print_progress, ShowBounds=False, ShowTicks=False, ShowTooltip=False, ShowValLabel=True, showLabel=True)
value_listener = ValueListener(Elements=create_toggle, SomeProperty=True)  # -> Values, Indices
value_listener_2 = ValueListener(Elements=create_toggle_2, SomeProperty=True)  # -> Values, Indices
create_stack = CreateStack(UIElements=[create_toggle_2, create_toggle], Horizontal=True)
value_listener_3 = ValueListener(Elements=create_slider, SomeProperty=True)  # -> Values, Indices
merge = Merge(Data1=create_label, Data2=create_stack, Data3=create_slider)
adjust_element_positioning = AdjustElementPositioning(
    ElementsToAdjust=[create_toggle, create_toggle_2],
    Margin="0,0,20,10",
    AbsolutePositioning=False,
    Width=Slider(155, range=0..1000),
    HorizontalAlignment=1)

# ---- group: 纹理设置
slide_to_adjust_density = Slider(100, range=10..500)
create_text_box = CreateTextBox(Label="Offset Count", DefaultText=Slider(2, range=0..10), UpdateButton=True, showLabel=True)
create_text_box_2 = CreateTextBox(Label="Scale Factor", DefaultText=Slider(0.75, range=0..1), UpdateButton=True, showLabel=True)
create_text_box_3 = CreateTextBox(Label="Fillet", DefaultText=Slider(0.6, range=0..1), UpdateButton=True, showLabel=True)
create_text_box_4 = CreateTextBox(Label="Line Width", DefaultText=Slider(0.4, range=0..1), UpdateButton=True, showLabel=True)
create_slider_2 = CreateSlider(Slider=slide_to_adjust_density, ShowBounds=False, ShowTicks=False, ShowTooltip=False, ShowValLabel=True, showLabel=True)
create_text_box_5 = CreateTextBox(Label="Unit Edge Length", DefaultText=Slider(4.6, range=0..10), UpdateButton=True, showLabel=True)
value_listener_4 = ValueListener(Elements=create_text_box_4, SomeProperty=True)  # -> Values, Indices
value_listener_5 = ValueListener(Elements=create_text_box_2, SomeProperty=True)  # -> Values, Indices
value_listener_6 = ValueListener(Elements=create_text_box_3, SomeProperty=True)  # -> Values, Indices
value_listener_7 = ValueListener(Elements=create_text_box, SomeProperty=True)  # -> Values, Indices
value_listener_8 = ValueListener(Elements=create_text_box_5, SomeProperty=True)  # -> Values, Indices
merge_2 = Merge(
    Data1=create_slider_2,
    Data2=create_text_box_5,
    Data3=create_text_box_2,
    Data4=create_text_box_3,
    Data5=create_text_box_4,
    Data6=create_text_box)

# ---- group: 自定义
factor = Slider(0.6, range=0..1)
create_rhino_pick_button = CreateRhinoPickButton(
    ButtonName="Click to select the custom texture unit in Rhino",
    Prompt="Please select geometry...",
    AllowMultiple=True,
    AllowNone=True,
    Type=0,
    ButtonStyle=0)
create_slider_3 = CreateSlider(Slider=factor, ShowBounds=False, ShowTicks=False, ShowTooltip=False, ShowValLabel=True, showLabel=True)
create_rhino_pick_button_2 = CreateRhinoPickButton(
    ButtonName="Click to select attractive points in Rhino",
    Prompt="Please select geometry...",
    AllowMultiple=True,
    AllowNone=True,
    Type=0,
    ButtonStyle=0)
boolean_toggle = BooleanToggle(True)
value_listener_9 = ValueListener(Elements=create_rhino_pick_button, SomeProperty=True)  # -> Values, Indices
value_listener_10 = ValueListener(Elements=create_rhino_pick_button_2, SomeProperty=True)  # -> Values, Indices
value_listener_11 = ValueListener(Elements=create_slider_3, SomeProperty=True)  # -> Values, Indices
merge_3 = Merge(Data1=create_rhino_pick_button, Data2=create_rhino_pick_button_2, Data3=create_slider_3)

# ---- group: 材料设置
create_text_box_6 = CreateTextBox(Label="Nozzle Temperature  (℃)  ", DefaultText="200", UpdateButton=True, showLabel=True)
create_text_box_7 = CreateTextBox(Label="Platform Temperature (℃)", DefaultText="60", UpdateButton=True, showLabel=True)
panel = Panel("""PLA    (Platform Temp.50℃, Nozzle Temp.205℃)
TPU    (Platform Temp.60℃, Nozzle Temp. 225℃)
ABS    (Platform Temp. 80℃, Nozzle Temp.260℃)
PETG  (Platform Temp. 65℃, Nozzle Temp. 250℃)
CUSTOM""")
create_list_box = CreateListBox(ListItems=panel, SelectedIndex=0, Height=100)
value_listener_12 = ValueListener(Elements=create_list_box, SomeProperty=True)  # -> Values, Indices
equality = Equality(FirstNumber=value_listener_12.Indices, SecondNumber="4")  # -> Equality, Inequality
merge_4 = Merge(Data1=create_list_box, Data2=create_text_box_7, Data3=create_text_box_6)
hide_show_element = HideShowElement(ElementToHideShow=[create_text_box_6, create_text_box_7], Show=equality.Equality, Collapse=True, Disable=False)

# ----
panel_2 = Panel("""Quad-Mesh
Tri-Mesh
Polygon-Mesh
Wavy
Coin
Truss
Floral
Spiral
Tri-Auxetic
Quad-Auxetic
Custom Texture""")
create_pulldown_menu = CreatePulldownMenu(ListItems=panel_2, SelectedIndex=3, showLabel=True)
create_label_2 = CreateLabel(LabelText="Step 2 : Texture Setting", LabelSize=12, Justification=0)
value_listener_13 = ValueListener(Elements=create_pulldown_menu, SomeProperty=True)  # -> Values, Indices
merge_5 = Merge(Data1=create_label_2, Data2=create_pulldown_menu)

# ---- group: path
首层打印速度 = Slider(20, range=0..100)
关闭点击按钮保存 = BooleanToggle(False)
是否必须保存 = BooleanToggle(True)
create_text_box_8 = CreateTextBox(Label="Other Layer Speed(mm/s)", DefaultText="60", UpdateButton=True, showLabel=True)
create_text_box_9 = CreateTextBox(Label="First Layer Speed(mm/s)", DefaultText=首层打印速度, UpdateButton=True, showLabel=True)
create_separator = CreateSeparator(Thickness=0.5, Horizontal=True, Color=ColourSwatch(SwatchColor=RGB(131, 145, 158)))
create_text_box_10 = CreateTextBox(Label="Top Layer Height (mm)", DefaultText="0.2", UpdateButton=True, showLabel=True)
create_text_box_11 = CreateTextBox(Label="Overlap Rate", DefaultText="0.05", UpdateButton=True, showLabel=True)
create_text_box_12 = CreateTextBox(Label="Other Layer Height (mm)", DefaultText="0.2", UpdateButton=True, showLabel=True)
create_text_box_13 = CreateTextBox(Label="Layer Number           ", DefaultText="1", UpdateButton=True, showLabel=True)
create_text_box_14 = CreateTextBox(Label="First Layer Height (mm)", DefaultText="0.2", UpdateButton=True, showLabel=True)
线宽 = CreateTextBox(Label="Line Width (mm)      ", DefaultText="0.4", UpdateButton=True, showLabel=True)
create_file_picker = CreateFilePicker(ButtonLabelText="Please select the path to save the file.", DialogType=2, MustExist=是否必须保存, Filter="All Files|*.*")
create_text_box_15 = CreateTextBox(Label="File Name", DefaultText="Pattern", UpdateButton=关闭点击按钮保存, showLabel=True)
value_listener_14 = ValueListener(Elements=create_text_box_10, SomeProperty=True)  # -> Values, Indices
value_listener_15 = ValueListener(Elements=create_text_box_13, SomeProperty=True)  # -> Values, Indices
value_listener_16 = ValueListener(Elements=create_text_box_12, SomeProperty=True)  # -> Values, Indices
value_listener_17 = ValueListener(Elements=create_text_box_11, SomeProperty=True)  # -> Values, Indices
value_listener_18 = ValueListener(Elements=create_text_box_8, SomeProperty=True)  # -> Values, Indices
value_listener_19 = ValueListener(Elements=create_text_box_9, SomeProperty=True)  # -> Values, Indices
value_listener_20 = ValueListener(Elements=create_text_box_14, SomeProperty=True)  # -> Values, Indices
value_listener_21 = ValueListener(Elements=线宽, SomeProperty=True)  # -> Values, Indices
panel_3 = Panel("""200
100
200
200
200""")
value_listener_22 = ValueListener(Elements=create_text_box_15, SomeProperty=True)  # -> Values, Indices
value_listener_23 = ValueListener(Elements=create_file_picker, SomeProperty=True)  # -> Values, Indices
merge_6 = Merge(
    Data1=线宽,
    Data2=create_text_box_13,
    Data3=create_text_box_14,
    Data4=create_text_box_10,
    Data5=create_text_box_12,
    Data6=create_text_box_11,
    Data7=create_separator,
    Data8=create_text_box_9,
    Data9=create_text_box_8)
list_item = ListItem(List=panel_3, Index=value_listener_12.Indices, Wrap=True)
set_textbox_contents = SetTextBoxContents(TextBoxToModify=create_text_box_8, NewTextBoxContents=list_item)

# ---- group: 机器设置
panel_4 = Panel("""Marlin（default）
Klipper""")
create_text_box_16 = CreateTextBox(Label="Platform X (mm)", DefaultText="256", UpdateButton=True, showLabel=True)
create_pulldown_menu_2 = CreatePulldownMenu(Label="G-code Style", ListItems=panel_4, SelectedIndex=0, showLabel=True)
create_text_box_17 = CreateTextBox(Label="Platform Y (mm)", DefaultText="256", UpdateButton=True, showLabel=True)
create_text_box_18 = CreateTextBox(Label="Lift Height (mm)", DefaultText="0", UpdateButton=True, showLabel=True)
create_text_box_19 = CreateTextBox(Label="Retraction Length (mm)", DefaultText="0.2", UpdateButton=True, showLabel=True)
value_listener_24 = ValueListener(Elements=create_pulldown_menu_2, SomeProperty=True)  # -> Values, Indices
value_listener_25 = ValueListener(Elements=create_text_box_16, SomeProperty=True)  # -> Values, Indices
value_listener_26 = ValueListener(Elements=create_text_box_17, SomeProperty=True)  # -> Values, Indices
value_listener_27 = ValueListener(Elements=create_text_box_19, SomeProperty=True)  # -> Values, Indices
value_listener_28 = ValueListener(Elements=create_text_box_18, SomeProperty=True)  # -> Values, Indices
merge_7 = Merge(
    Data1=create_text_box_16,
    Data2=create_text_box_17,
    Data3=create_text_box_19,
    Data4=create_text_box_18,
    Data5=create_pulldown_menu_2)

# ----
create_rhino_pick_button_3 = CreateRhinoPickButton(
    ButtonName="Click to select the planar closed curve in Rhino",
    Prompt="Please select geometry...",
    AllowMultiple=True,
    AllowNone=True,
    Type=0,
    ButtonStyle=0)
create_label_3 = CreateLabel(LabelText="Step 1: Contour Drawing", LabelSize=12, Justification=0)
merge_8 = Merge(Data1=create_label_3, Data2=create_rhino_pick_button_3)
value_listener_29 = ValueListener(Elements=create_rhino_pick_button_3, SomeProperty=True)  # -> Values, Indices

# ---- group: 导出gcode按钮
create_button = CreateButton(ButtonName="Export", ButtonStyle=0)
value_listener_30 = ValueListener(Elements=create_button, SomeProperty=True)  # -> Values, Indices

# ---- group: 材料设置 / 挤出温度
panel_5 = Panel("""205
225
260
250""")
value_listener_31 = ValueListener(Elements=create_text_box_6, SomeProperty=True)  # -> Values, Indices
list_item_2 = ListItem(List=panel_5, Index=value_listener_12.Indices, Wrap=True)
stream_filter = StreamFilter(Gate=equality.Equality, Stream0=list_item_2, Stream1=value_listener_31.Values)

# ---- group: 材料设置 / 平台温度
panel_6 = Panel("""50
60
80
65""")
value_listener_32 = ValueListener(Elements=create_text_box_7, SomeProperty=True)  # -> Values, Indices
list_item_3 = ListItem(List=panel_6, Index=value_listener_12.Indices, Wrap=True)
stream_filter_2 = StreamFilter(Gate=equality.Equality, Stream0=list_item_3, Stream1=value_listener_32.Values)

# ----
create_label_4 = CreateLabel(LabelText="Export successfully！", LabelSize=12, Justification=0)

adjust_element_appearance = AdjustElementAppearance(
    ElementsToAdjust=create_label_4,
    Foreground=ColourSwatch(SwatchColor=RGB(63, 101, 134)),
    FontSize=Slider(16, range=0..100))
adjust_element_positioning_2 = AdjustElementPositioning(
    ElementsToAdjust=create_label_4,
    AbsolutePositioning=False,
    Width=Slider(260, range=0..1000),
    HorizontalAlignment=2,
    VerticalAlignment=1)

value_listener_33 = ValueListener(Elements=create_slider_2, SomeProperty=True)  # -> Values, Indices

# ---- group: 密度显示条件
equality_2 = Equality(FirstNumber=value_listener_13.Indices, SecondNumber="0")  # -> Equality, Inequality
equality_3 = Equality(FirstNumber=value_listener_13.Indices, SecondNumber="3")  # -> Equality, Inequality
equality_4 = Equality(FirstNumber=value_listener_13.Indices, SecondNumber="4")  # -> Equality, Inequality
equality_5 = Equality(FirstNumber=value_listener_13.Indices, SecondNumber="5")  # -> Equality, Inequality
equality_6 = Equality(FirstNumber=value_listener_13.Indices, SecondNumber="6")  # -> Equality, Inequality
equality_7 = Equality(FirstNumber=value_listener_13.Indices, SecondNumber="10")  # -> Equality, Inequality
equality_8 = Equality(FirstNumber=value_listener_13.Indices, SecondNumber="7")  # -> Equality, Inequality
gate_or = GateOr(
    A=equality_2.Equality,
    B=equality_3.Equality,
    C=equality_4.Equality,
    D=equality_5.Equality,
    F=equality_6.Equality,
    E=equality_8.Equality,
    G=equality_7.Equality)
hide_show_element_2 = HideShowElement(ElementToHideShow=create_slider_2, Show=gate_or, Collapse=True, Disable=False)

# ---- group: 动态显示自定义纹理
equality_9 = Equality(FirstNumber=value_listener_13.Indices, SecondNumber="10")  # -> Equality, Inequality
hide_show_element_3 = HideShowElement(ElementToHideShow=merge_3, Show=equality_9.Equality, Collapse=True, Disable=False)

# ---- group: 拉伸结构显示条件
equality_10 = Equality(FirstNumber=value_listener_13.Indices, SecondNumber=Slider(8, range=0..10))  # -> Equality, Inequality
equality_11 = Equality(FirstNumber=value_listener_13.Indices, SecondNumber=Slider(9, range=0..10))  # -> Equality, Inequality
merge_9 = Merge(Data1=create_text_box_2, Data2=create_text_box_4, Data3=create_text_box)
gate_or_2 = GateOr(A=equality_11.Equality, B=equality_10.Equality)
hide_show_element_4 = HideShowElement(ElementToHideShow=create_text_box_3, Show=equality_10.Equality, Collapse=True, Disable=False)
hide_show_element_5 = HideShowElement(ElementToHideShow=merge_9, Show=gate_or_2, Collapse=True, Disable=False)

# ----
adjust_element_appearance_2 = AdjustElementAppearance(
    ElementsToAdjust=create_label_3,
    Foreground=ColourSwatch(SwatchColor=RGB(255, 255, 255)),
    Background=ColourSwatch(SwatchColor=RGB(131, 145, 158)))
adjust_element_positioning_3 = AdjustElementPositioning(ElementsToAdjust=create_label_3, Margin="0,15,0,0", AbsolutePositioning=False)

adjust_element_positioning_4 = AdjustElementPositioning(ElementsToAdjust=create_label_2, Margin="0,15,0,0", AbsolutePositioning=False)
adjust_element_appearance_3 = AdjustElementAppearance(
    ElementsToAdjust=create_label_2,
    Foreground=ColourSwatch(SwatchColor=RGB(255, 255, 255)),
    Background=ColourSwatch(SwatchColor=RGB(131, 145, 158)))

adjust_element_positioning_5 = AdjustElementPositioning(ElementsToAdjust=create_label, Margin="0,15,0,5", AbsolutePositioning=False)
adjust_element_appearance_4 = AdjustElementAppearance(
    ElementsToAdjust=create_label,
    Foreground=ColourSwatch(SwatchColor=RGB(255, 255, 255)),
    Background=ColourSwatch(SwatchColor=RGB(131, 145, 158)))

# ---- group: 选择文件style
选择文件组件高度 = Slider(40, range=0..100)
adjust_element_positioning_6 = AdjustElementPositioning(ElementsToAdjust=create_file_picker, AbsolutePositioning=False, Height=选择文件组件高度)

# ---- group: 材料设置style
adjust_element_positioning_7 = AdjustElementPositioning(ElementsToAdjust=create_list_box, Margin="0,5,0,10", AbsolutePositioning=False)

# ---- group: 分割线样式
adjust_element_positioning_8 = AdjustElementPositioning(ElementsToAdjust=create_separator, Margin="0,10,0,10", AbsolutePositioning=False)

# ----
curve = Curve(value_listener_29.Values)
quad_remesh_settings = QuadRemeshSettings(
    TargetCount=value_listener_33.Values,
    AdaptiveSize=0,
    AdaptiveCount=False,
    HardEdges=False,
    SeamEdges=0,
    Symmetry=0,
    GuideCurves=0)
stream_gate = StreamGate(Stream=curve, Gate=value_listener_13.Indices)  # -> Target0, Target1, Target2, Target3, Target4, Target5, Target6, Target7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
curve_2 = Curve(value_listener_29.Values)

brep = Brep(stream_gate.Target3)
quad_remesh = QuadRemesh(Mesh=brep, Settings=quad_remesh_settings)
wavy = WavyStructure(input_mesh=quad_remesh)  # -> flatten(output_curve_texture)

brep_2 = Brep(stream_gate.Target5)
quad_remesh_2 = QuadRemesh(Mesh=brep_2, Settings=quad_remesh_settings)
truss = Truss(input_mesh=quad_remesh_2)  # -> flatten(output_curve_texture)

# ---- group: polygon mesh
brep_3 = Brep(stream_gate.Target2)
triremesh = TriRemesh(Geometry=brep_3, Length=value_listener_8.Values, Iterations=25)  # -> Triangulation, Dual, Creases
mesh_edges = MeshEdges(Mesh=triremesh.Dual)  # -> NakedEdges, InteriorEdges, NonManifoldEdges
join_curves = JoinCurves(Curves=[mesh_edges.NakedEdges, mesh_edges.InteriorEdges], Preserve=False)  # -> flatten(Curves)

# ----
brep_4 = Brep(stream_gate.Target7)
quad_remesh_3 = QuadRemesh(Mesh=brep_4, Settings=quad_remesh_settings)
sprial = Sprial(input_mesh=quad_remesh_3)  # -> flatten(output_curve_texture)

# ---- group: quad-mesh
brep_5 = Brep(stream_gate.Target0)
quad_remesh_4 = QuadRemesh(Mesh=brep_5, Settings=quad_remesh_settings)
mesh_edges_2 = MeshEdges(Mesh=quad_remesh_4)  # -> NakedEdges, InteriorEdges, NonManifoldEdges
join_curves_2 = JoinCurves(Curves=[mesh_edges_2.NakedEdges, mesh_edges_2.InteriorEdges], Preserve=False)  # -> flatten(Curves)

# ---- group: tri-mesh
brep_6 = Brep(stream_gate.Target1)
triremesh_2 = TriRemesh(Geometry=brep_6, Length=value_listener_8.Values, Iterations=25)  # -> Triangulation, Dual, Creases
mesh_edges_3 = MeshEdges(Mesh=triremesh_2.Triangulation)  # -> NakedEdges, InteriorEdges, NonManifoldEdges
join_curves_3 = JoinCurves(Curves=[mesh_edges_3.NakedEdges, mesh_edges_3.InteriorEdges], Preserve=False)  # -> flatten(Curves)

# ----
cluster = Cluster(
    contour_curve=stream_gate.Target10,
    target_count=value_listener_33.Values,
    attractive_point=value_listener_10.Values,
    factor=value_listener_11.Values)

# ---- group: 纹理
int = Integer()
mesh = Mesh(cluster)
crv = Curve(value_listener_9.Values)
python = GhPythonScript(x=int)  # -> a
# ---------- python: Python ----------
if x is None:
    x = 0
a = x
# ---------- end python ----------
faceb = FaceBoundaries(Mesh=mesh)
multiplication = Multiplication(A=python, B="0.5")
medges = MeshEdges(Mesh=mesh)  # -> NakedEdges, InteriorEdges, NonManifoldEdges
pi = Pi(Factor=multiplication)
rotate = Rotate(Geometry=crv, Angle=pi, Plane=PlaneXY(0, 0, 0))  # -> Geometry, Transform
bbox = BoundingBox(Content=rotate.Geometry, Plane=PlaneXY(0, 0, 0), UnionBox=True)  # -> Box, Box_2
debox = DeconstructBox(Box=bbox.Box)  # -> Plane, X, Y, Z
rectangle = Rectangle(Plane=PlaneXY(0, 0, 0), XSize=debox.X, YSize=debox.Y, Radius=0)  # -> Rectangle, Length
map_srf = MapToSurface(Curve=rotate.Geometry, Source=rectangle.Rectangle, Target=graft(faceb))  # -> flatten(Curve)
join = JoinCurves(Curves=medges.NakedEdges, Preserve=False)
join_2 = JoinCurves(Curves=map_srf, Preserve=False)
merge_10 = Merge(Data1=join, Data2=join_2)
crv_2 = Curve(flatten(merge_10))

# ----
merge_11 = Merge(Data1=medges.NakedEdges, Data2=medges.InteriorEdges)
length = Length(Curve=merge_11)
bounds = Bounds(Numbers=length)
deconstruct_domain = DeconstructDomain(Domain=bounds)  # -> Start, End

brep_7 = Brep(stream_gate.Target6)
quad_remesh_5 = QuadRemesh(Mesh=brep_7, Settings=quad_remesh_settings)
floral = Floral(input_mesh=quad_remesh_5)  # -> flatten(output_curve_texture)

brep_8 = Brep(stream_gate.Target4)
quad_remesh_6 = QuadRemesh(Mesh=brep_8, Settings=quad_remesh_settings)
coin = Coin(input_mesh=quad_remesh_6)  # -> flatten(output_curve_texture)

# ---- group: 拉伸纹理
tri_auxetic = TriAuxeticStructure(
    contour_curve=stream_gate.Target8,
    unit_size=value_listener_8.Values,
    scale_factor=value_listener_5.Values,
    fillet=value_listener_6.Values,
    offset_width=value_listener_4.Values,
    offset_count=value_listener_7.Values)
quad_auxetic = QuadAuxeticStructure(
    contour_curve=stream_gate.Target9,
    unit_size=value_listener_8.Values,
    scale_factor=value_listener_5.Values,
    offset_width=value_listener_4.Values,
    offset_count=value_listener_7.Values)

# ---- group: 体积可视化窗口
rectangle_2 = Rectangle({Plane=PlaneXY(-10, -10, 0), Size=Domain2(u=-10..10, v=-10..10)})
mesh_2 = Mesh(rectangle_2)
create_3d_view = Create3DView(
    MeshToDisplay=mesh_2,
    MeshColors=ColourSwatch(SwatchColor=RGB(128, 128, 128)),
    ViewWidth=Slider(350, range=0..1000),
    ViewHeight=Slider(170, range=0..1000))

# ---- group: 不预览不计算
stream_gate_2 = StreamGate(Stream=rectangle_2, Gate=value_listener_2.Values)  # -> Target0, Target1
brep_9 = Brep(stream_gate_2.Target1)

# ----
stream_filter_3 = StreamFilter(
    Gate=value_listener_13.Indices,
    Stream0=join_curves_2,
    Stream1=join_curves_3,
    Stream2=join_curves,
    Stream3=wavy,
    Stream4=coin,
    Stream5=truss,
    Stream6=floral,
    Stream7=sprial,
    Stream8=tri_auxetic,
    Stream9=quad_auxetic,
    Stream10=crv_2)

# ---- group: 比例缩小
area = Area(Geometry=curve_2)  # -> Area, Centroid
area_2 = Area(Geometry=stream_gate_2.Target1)  # -> Area, Centroid
division = Division(A=area_2.Area, B=area.Area)
multiplication_2 = Multiplication(A=division, B=value_listener_33.Values)

# ----
stream_filter_4 = StreamFilter(Gate=value_listener_2.Values, Stream1=value_listener_3.Values)

# ---- group: 体积可视化文字提示
create_label_5 = CreateLabel(LabelText="Partial texture 3D view display", LabelSize=12, Justification=1)
adjust_element_appearance_5 = AdjustElementAppearance(ElementsToAdjust=create_label_5, Foreground=ColourSwatch(SwatchColor=RGB(131, 145, 158)))

# ----
quad_remesh_settings_2 = QuadRemeshSettings(
    TargetCount=multiplication_2,
    AdaptiveSize=0,
    AdaptiveCount=False,
    HardEdges=False,
    SeamEdges=0,
    Symmetry=0,
    GuideCurves=0)
stream_gate_3 = StreamGate(Stream=stream_gate_2.Target1, Gate=value_listener_13.Indices)  # -> Target0, Target1, Target2, Target3, Target4, Target5, Target6, Target7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
stream_gate_4 = StreamGate(Stream=brep_9, Gate=value_listener_13.Indices)  # -> Target0, Target1, Target2, Target3, Target4, Target5, Target6, Target7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

# ---- group: 自定义纹理
number_slider = Slider(3, range=0..10)
multiplication_3 = Multiplication(A=number_slider, B=deconstruct_domain.Start)
rectangle_3 = Rectangle(Plane=PlaneXY(0, 0, 0), XSize=multiplication_3, YSize=multiplication_3, Radius=0)  # -> Rectangle, Length
mesh_plane = MeshPlane(Boundary=rectangle_3.Rectangle, WidthCount=number_slider, HeightCount=number_slider)  # -> Mesh, Area
crv_3 = Curve(value_listener_9.Values)
int_2 = Integer()
mesh_3 = Mesh(mesh_plane.Mesh)
python_2 = GhPythonScript(x=int_2)  # -> a; same code as python
faceb_2 = FaceBoundaries(Mesh=mesh_3)
multiplication_4 = Multiplication(A=python_2, B="0.5")
pi_2 = Pi(Factor=multiplication_4)
rotate_2 = Rotate(Geometry=crv_3, Angle=pi_2, Plane=PlaneXY(0, 0, 0))  # -> Geometry, Transform
medges_2 = MeshEdges(Mesh=mesh_3)  # -> NakedEdges, InteriorEdges, NonManifoldEdges
bbox_2 = BoundingBox(Content=rotate_2.Geometry, Plane=PlaneXY(0, 0, 0), UnionBox=True)  # -> Box, Box_2
debox_2 = DeconstructBox(Box=bbox_2.Box)  # -> Plane, X, Y, Z
rectangle_4 = Rectangle(Plane=PlaneXY(0, 0, 0), XSize=debox_2.X, YSize=debox_2.Y, Radius=0)  # -> Rectangle, Length
map_srf_2 = MapToSurface(Curve=rotate_2.Geometry, Source=rectangle_4.Rectangle, Target=graft(faceb_2))  # -> flatten(Curve)
join_3 = JoinCurves(Curves=medges_2.NakedEdges, Preserve=False)
join_4 = JoinCurves(Curves=map_srf_2, Preserve=False)
merge_12 = Merge(Data1=join_3, Data2=join_4)
crv_4 = Curve(flatten(merge_12))

# ---- group: 3
quad_remesh_7 = QuadRemesh(Mesh=stream_gate_4.Target3, Settings=quad_remesh_settings_2)
wavy_2 = WavyStructure(input_mesh=quad_remesh_7)  # -> flatten(output_curve_texture)

# ---- group: 5
quad_remesh_8 = QuadRemesh(Mesh=stream_gate_4.Target5, Settings=quad_remesh_settings_2)
truss_2 = Truss(input_mesh=quad_remesh_8)  # -> flatten(output_curve_texture)

# ---- group: Tri-Mesh
triremesh_3 = TriRemesh(Geometry=stream_gate_4.Target1, Length=value_listener_8.Values, Iterations=25)  # -> Triangulation, Dual, Creases
mesh_edges_4 = MeshEdges(Mesh=triremesh_3.Triangulation)  # -> NakedEdges, InteriorEdges, NonManifoldEdges
join_curves_4 = JoinCurves(Curves=[mesh_edges_4.NakedEdges, mesh_edges_4.InteriorEdges], Preserve=False)  # -> flatten(Curves)

# ---- group: Polygon-Mesh
triremesh_4 = TriRemesh(Geometry=stream_gate_4.Target2, Length=value_listener_8.Values, Iterations=25)  # -> Triangulation, Dual, Creases
mesh_edges_5 = MeshEdges(Mesh=triremesh_4.Dual)  # -> NakedEdges, InteriorEdges, NonManifoldEdges
join_curves_5 = JoinCurves(Curves=[mesh_edges_5.NakedEdges, mesh_edges_5.InteriorEdges], Preserve=False)  # -> flatten(Curves)

# ---- group: Quad-Mesh
quad_remesh_9 = QuadRemesh(Mesh=stream_gate_4.Target0, Settings=quad_remesh_settings_2)
mesh_edges_6 = MeshEdges(Mesh=quad_remesh_9)  # -> NakedEdges, InteriorEdges, NonManifoldEdges
join_curves_6 = JoinCurves(Curves=[mesh_edges_6.NakedEdges, mesh_edges_6.InteriorEdges], Preserve=False)  # -> flatten(Curves)

# ---- group: 4
quad_remesh_10 = QuadRemesh(Mesh=stream_gate_4.Target4, Settings=quad_remesh_settings_2)
coin_2 = Coin(input_mesh=quad_remesh_10)  # -> flatten(output_curve_texture)

# ----
tri_auxetic_2 = TriAuxeticStructure(
    contour_curve=stream_gate_3.Target8,
    unit_size=value_listener_8.Values,
    scale_factor=value_listener_5.Values,
    fillet=value_listener_6.Values,
    offset_width=value_listener_4.Values,
    offset_count=value_listener_7.Values)
quad_auxetic_2 = QuadAuxeticStructure(
    contour_curve=stream_gate_3.Target9,
    unit_size=value_listener_8.Values,
    scale_factor=value_listener_5.Values,
    offset_width=value_listener_4.Values,
    offset_count=value_listener_7.Values)

# ---- group: 6
quad_remesh_11 = QuadRemesh(Mesh=stream_gate_4.Target6, Settings=quad_remesh_settings_2)
floral_2 = Floral(input_mesh=quad_remesh_11)  # -> flatten(output_curve_texture)

# ---- group: 7
quad_remesh_12 = QuadRemesh(Mesh=stream_gate_4.Target7, Settings=quad_remesh_settings_2)
sprial_2 = Sprial(input_mesh=quad_remesh_12)  # -> flatten(output_curve_texture)

# ----
stream_filter_5 = StreamFilter(
    Gate=value_listener_13.Indices,
    Stream0=join_curves_6,
    Stream1=join_curves_4,
    Stream2=join_curves_5,
    Stream3=wavy_2,
    Stream4=coin_2,
    Stream5=truss_2,
    Stream6=floral_2,
    Stream7=sprial_2,
    Stream8=tri_auxetic_2,
    Stream9=quad_auxetic_2,
    Stream10=crv_4)
multi_layer = MultiLayer(
    curves=stream_filter_3,
    first_layer_thickness=value_listener_20.Values,
    layer_thickness=value_listener_16.Values,
    top_layer_thickness=value_listener_14.Values,
    layer_count=value_listener_15.Values)  # -> flatten(curve)
multi_layer_2 = MultiLayer(
    curves=stream_filter_5,
    first_layer_thickness=value_listener_20.Values,
    layer_thickness=value_listener_16.Values,
    top_layer_thickness=value_listener_14.Values,
    layer_count=value_listener_15.Values)  # -> flatten(curve)
volume_preview = VolumePreview(printing_curves=multi_layer_2, line_width=value_listener_21.Values)
stream_gate_5 = StreamGate(Stream=multi_layer, Gate=value_listener.Values)  # -> Target0, Target1
stream_gate_6 = StreamGate(Stream=volume_preview, Gate=value_listener_2.Values)  # -> Target0, Target1
hide_show_element_6 = HideShowElement(ElementToHideShow=[create_3d_view, create_label_5], Show=value_listener_2.Values, Collapse=True, Disable=False)
lpath_optimization = LocalPathOptimization(input_curve=stream_gate_5.Target1)
set_3d_view = Set3DView(_3DView=create_3d_view, MeshToDisplay=stream_gate_6.Target1)
stream_filter_6 = StreamFilter(Gate=value_listener.Values, Stream0=stream_gate_5.Target0, Stream1=lpath_optimization)
process_visualization = ProcessVisualization(input_curve=stream_filter_6, printing_process=stream_filter_4)  # -> visual_curve, nozzle
dispatch = Dispatch(List=stream_filter_6, DispatchPattern=value_listener_2.Values)  # -> ListA, ListB
custom_preview = CustomPreview(Geometry=dispatch.ListB, Material=ColourSwatch(SwatchColor=RGB(37, 30, 27)))
空走速度 = Slider(300, range=0..1000)
stream_gate_7 = StreamGate(Stream=stream_filter_6, Gate=value_listener_30.Values)  # -> Target0, Target1
gcode_solver = GcodeSolver(
    input_curves=stream_gate_7.Target1,
    platform_width=value_listener_25.Values,
    platform_height=value_listener_26.Values,
    platform_temperature=stream_filter_2,
    travel_speed=空走速度,
    printing_speed_for_first_layer=value_listener_19.Values,
    printing_speed_for_other_layer=value_listener_18.Values,
    line_width=value_listener_21.Values,
    overlapping_ratio=value_listener_17.Values,
    material_diameter=1.75,
    nozzle_temprature=stream_filter,
    retraction_length=value_listener_27.Values,
    lift_z=value_listener_28.Values,
    gcode_style=value_listener_24.Indices)  # -> gcode, layer, time, platform, printing_path, travel_path
data_recorder = DataRecorder(flatten(gcode_solver.time), DataLimit=-1, RecordData=True)
export = ExportGCode(
    gcode_text=gcode_solver.gcode,
    path_folder=value_listener_23.Values,
    file_name=value_listener_22.Values,
    update=value_listener_30.Values)
number = Number(flatten(data_recorder))
data_dam = DataDam(DataDataA=number, BufferDelay=100000000, BufferMode=2)
list_length = ListLength(List=number)
data_dam_2 = DataDam(DataDataA=data_dam, BufferDelay=100000000, BufferMode=2)
list_length_2 = ListLength(List=data_dam_2)
equality_12 = Equality(FirstNumber=list_length_2, SecondNumber=list_length)  # -> Equality, Inequality
hide_show_element_7 = HideShowElement(ElementToHideShow=create_label_4, Show=equality_12.Inequality, Collapse=True, Disable=False)

# ---- group: Tab
panel_7 = Panel("""Machine
Material
Path""")
create_label_6 = CreateLabel(LabelText="Step 4 : Gcode Generation", LabelSize=12, Justification=0)
tabbed_view = TabbedView(
    TabNames=panel_7,
    TabTextSize=Slider(18, range=0..100),
    Tab0=flatten(merge_7),
    Tab1=flatten(merge_4),
    Tab2=flatten(merge_6))

# ----
get_element_properties = GetElementProperties(UIElement=tabbed_view)  # -> PropertyNames, PropertyTypes
create_scroll_viewer = CreateScrollViewer(
    UIElements=tabbed_view,
    HorizontalScrollBarVisibility=0,
    VerticalScrollBarVisibility=0,
    Height=Slider(220, range=0..1000))

# ---- group: Tab (continued)
create_expander = CreateExpander(UIElements=create_scroll_viewer, Header="Printing Settings", Open=True)
merge_13 = Merge(Data1=create_label_6, Data2=create_expander, Data3=create_file_picker, Data4=create_text_box_15)

# ----
adjust_element_appearance_6 = AdjustElementAppearance(
    ElementsToAdjust=create_label_6,
    Foreground=ColourSwatch(SwatchColor=RGB(255, 255, 255)),
    Background=ColourSwatch(SwatchColor=RGB(131, 145, 158)))
adjust_element_positioning_9 = AdjustElementPositioning(ElementsToAdjust=create_label_6, Margin="0,15,0,10", AbsolutePositioning=False)

merge_14 = Merge(
    Data1=merge_8,
    Data2=merge_5,
    Data3=merge_3,
    Data4=merge_2,
    Data5=merge,
    Data6=create_3d_view,
    Data7=create_label_5,
    Data8=merge_13,
    Data9=create_button,
    Data10=create_label_4)

# ---- group: 主体装口
number_slider_2 = Slider(400, range=0..1000)
get_screen_dimensions = GetScreenDimensions()  # -> Width, Height
subtraction = Subtraction(A=get_screen_dimensions.Width, B=number_slider_2)
launch_window = LaunchWindow(
    Show=Toggle(True),
    Name="Freeslicer",
    Width=number_slider_2,
    Height=get_screen_dimensions.Height,
    ChildStatus=1,
    EnableHorizScroll=False)
是否水平 = BooleanToggle(False)
text = Text(subtraction)
text_join = TextJoin(Text=[text, "0"], Join=",")
value_list = ValueList({"amber": "Amber", "blue": "Blue", "brown": "Brown", "cobalt": "Cobalt", "crimson": "Crimson", "cyan": "Cyan", "emerald": "Emerald", "green": "Green", "indigo": "Indigo", "lime": "Lime", "magenta": "Magenta", "mauve": "Mauve", "olive": "Olive", "orange": "Orange", "pink": "Pink", "purple": "Purple", "red": "Red", "sienna": "Sienna", "steel": "Steel", "taupe": "Taupe", "teal": "Teal", "violet": "Violet", "yellow": "Yellow"}, selected="steel")
create_stack_2 = CreateStack(UIElements=merge_14, Horizontal=是否水平)
point = Point(text_join)
set_window_properties = SetWindowProperties(Window=launch_window, StartingLocation=point, AccentColor=value_list, ShowTitleBar=Toggle(True), ScaleFactor=1)
add_elements = AddElements(Window=launch_window, Elements=flatten(create_stack_2), DoVLChecking=True)  # -> AddedElements, ElementNames

# ---- group: 整体宽度
adjust_element_positioning_10 = AdjustElementPositioning(
    ElementsToAdjust=merge_14,
    AbsolutePositioning=False,
    Width=Slider(350, range=0..1000),
    HorizontalAlignment=1,
    VerticalAlignment=1)

# ---- group: 单元宽度现实条件
equality_13 = Equality(FirstNumber=value_listener_13.Indices, SecondNumber="1")  # -> Equality, Inequality
equality_14 = Equality(FirstNumber=value_listener_13.Indices, SecondNumber="2")  # -> Equality, Inequality

# ----
gate_or_3 = GateOr(A=equality_13.Equality, B=equality_14.Equality, C=equality_11.Equality, D=equality_10.Equality)

# ---- group: 单元宽度现实条件 (continued)
hide_show_element_8 = HideShowElement(ElementToHideShow=create_text_box_5, Show=gate_or_3, Collapse=True, Disable=False)

# ==== cluster ExportGCode: Export GCode
path_folder = ClusterInput()  # Export address
file_name = ClusterInput()  # File name
gcode_text = ClusterInput()  # Input GCode text
update = ClusterInput()  # Update file
txt = Text(path_folder)
txt_2 = Text(file_name)
bool = Boolean(update)
txt_3 = Text(gcode_text)
export = ExportFile(gcode=txt_3, path=txt, name=txt_2, update=bool)  # inputs gcode: list, update: Boolean
# ---------- export: Python ----------
__author__ = "littlechao PC"
__version__ = "2023.07.08"

import rhinoscriptsyntax as rs

if name is None:
    name = 'gh_gcode'

file = '\{n}.gcode'.format(n=name)
path = path + file
if update is True:
    with open(path, 'w') as f:
        for line in gcode:
            f.writelines(line)
            f.write('\n')
# ---------- end export ----------

# ==== cluster ProcessVisualization: Printing process visualization from 0 to 1
printing_process = ClusterInput()  # Printing process from 0 to 1
input_curve = ClusterInput()  # Input curve as list
crv = Curve(input_curve)
num = Number(printing_process)
road_visualization = RoadVisualization(crv=flatten(crv), rate=num)  # -> out, a, b; inputs crv: list of Curve
# ---------- road_visualization: Python ----------
import rhinoscriptsyntax as rs

if accuracy is None: accuracy = 0.3
if accuracy == 0: accuracy = 0.1
pts = []
for i in range(len(crv)):
    crv_pts = rs.DivideCurveLength(crv[i], accuracy)
    end_pt = rs.CurveEndPoint(crv[i])
    pts.extend(crv_pts)
    if crv_pts[-1] != end_pt:
        pts.append(end_pt)



tmp = []
length = int(len(pts)*rate)
if length > 1:
    for k in range(length):
        tmp.append(pts[k])
    a = rs.AddPolyline(tmp)
    nozzle_plane = rs.CreatePlane(tmp[-1],
                                  rs.CreateVector(1,0,0),
                                  rs.CreateVector(0,1,0))
    b = rs.AddCone(nozzle_plane, 5.0, 5.0, cap=True)
# ---------- end road_visualization ----------
brep = Brep(road_visualization.b)
crv_2 = Curve(road_visualization.a)
nozzle = ClusterOutput(brep)  # Visualization of the nozzle
visual_curve = ClusterOutput(crv_2)  # Visualization of the printing path

# ==== cluster VolumePreview: Preview printing path with volume
line_width = ClusterInput()  # Default is 0.4 mm
printing_curves = ClusterInput()  # Input printing curves from Gcode Solver
crv = Curve(flatten(printing_curves))
num = Number(line_width)
rad = Radians(Degrees="15")
topoly = CurveToPolyline(Curve=crv, ToleranceDistance=0, ToleranceAngle=rad)  # -> Polyline, Segments
explode = Explode(Curve=topoly.Polyline, Recursive=True)  # -> Segments, Vertices
cpoly = ControlPolygon(Curve=explode.Segments)  # -> Polygon, Points
crv_cp = CurveClosestPoint(Point=cpoly.Points, Curve=graft(cpoly.Polygon))  # -> Point, Parameter, Distance
eval = EvaluateCurve(Curve=graft(cpoly.Polygon), Parameter=crv_cp.Parameter)  # -> Point, Tangent, Angle
pdecon = Deconstruct(Point=eval.Point)  # -> XComponent, YComponent, ZComponent
cset = CreateSet(List=flatten(pdecon.ZComponent))  # -> Set, Map
cull_i = CullIndex(List=cset.Set, Indices="0", Wrap=True)
cull_i_2 = CullIndex(List=cset.Set, Indices="-1", Wrap=True)
item = ListItem(List=cset.Set, Index="0", Wrap=True)
subtraction = Subtraction(A=cull_i, B=cull_i_2)
lng = ListLength(List=cset.Set)
ins = InsertItems(List=subtraction, Item=item, Indices="0", Wrap=True)
smaller = SmallerThan(FirstNumber=lng, SecondNumber="2")  # -> SmallerThan, OrEqualTo
item_2 = ListItem(List=ins, Index=cset.Map, Wrap=True)
unflatten = UnflattenTree(Tree=item_2, Guide=pdecon.ZComponent)
filter = StreamFilter(Gate=smaller.SmallerThan, Stream0=unflatten, Stream1=pdecon.ZComponent)
division = Division(A=filter, B="-2")
Z = UnitZ(Factor=1)
Z_2 = UnitZ(Factor=division)
xprod = CrossProduct(VectorA=eval.Tangent, VectorB=Z, Unitize=True)  # -> Vector, Length
move = Move(Geometry=eval.Point, Motion=Z_2)  # -> Geometry, Transform
pl = ConstructPlane(Origin=move.Geometry, XAxis=xprod.Vector, YAxis=Z)
division_2 = Division(A=num, B="2")
division_3 = Division(A=filter, B="2")
dom = ConstructDomain(DomainStart=expr("-x", division_3), DomainEnd=division_3)
dom_2 = ConstructDomain(DomainStart=expr("-x", division_2), DomainEnd=division_2)
rectangle = Rectangle(Plane=pl, XSize=dom_2, YSize=dom, Radius=0)  # -> Rectangle, Length
cpoly_2 = ControlPolygon(Curve=rectangle.Rectangle)  # -> Polygon, Points
number_slider = Slider(4, range=0..10)
cull_i_3 = CullIndex(List=cpoly_2.Points, Indices="-1", Wrap=True)  # -> simplify(List)
trim = TrimTree(Tree=cull_i_3, Depth=1)
series = Series(Start="1", Step="0", Count=number_slider)
series_2 = Series(Start="0", Step="0", Count=number_slider)
merge = Merge(Data1=series, Data2=series_2)
dispatch = Dispatch(List=trim, DispatchPattern=merge)  # -> ListA, ListB
shift = ShiftList(List=dispatch.ListA, Shift=1, Wrap=True)
shift_2 = ShiftList(List=dispatch.ListB, Shift=1, Wrap=True)
weave = Weave(Pattern=[0, 1, 2, 3], Stream0=dispatch.ListA, Stream1=shift, Stream2=shift_2, Stream3=dispatch.ListB, NullGaps=False)
series_3 = Series(Start=0, Step=1, Count=number_slider)
multiplication = Multiplication(A="4", B=series_3)
series_4 = Series(Start=multiplication, Step=1, Count="4")
item_3 = ListItem(List=series_4, Index=0, Wrap=True)  # -> Item, Item1, Item2, Item3
quad = MeshQuad(CornerA=item_3.Item, CornerB=item_3.Item1, CornerC=item_3.Item2, CornerD=item_3.Item3)  # -> flatten(Face)
conmesh = ConstructMesh(Vertices=weave, Faces=quad)  # -> flatten(Mesh)
mjoin = MeshJoin(Meshes=conmesh)
clean = CombineClean(Meshes=mjoin)
demesh = DeconstructMesh(Mesh=clean)  # -> Vertices, Faces, Colours, Normals
pdecon_2 = Deconstruct(Point=demesh.Vertices)  # -> XComponent, YComponent, ZComponent
bnd = Bounds(Numbers=pdecon_2.ZComponent)
dedomain = DeconstructDomain(Domain=bnd)  # -> Start, End
gradient = Gradient(
    LowerLimit=dedomain.End,
    UpperLimit=dedomain.Start,
    Parameter=pdecon_2.ZComponent,
    stops=[0: RGB(255, 130, 160), 1: RGB(220, 0, 40)])
conmesh_2 = ConstructMesh(Vertices=demesh.Vertices, Faces=demesh.Faces, Colours=gradient)
volume_mesh = ClusterOutput(conmesh_2)  # Display printing volume

# ==== cluster MultiLayer: Generate multi-layer curves as tree list
first_layer_thickness = ClusterInput()  # First layer thickness
curves = ClusterInput()  # Input curves
layer_thickness = ClusterInput()  # Other layer thickness
top_layer_thickness = ClusterInput()  # Top layer thickness
layer_count = ClusterInput()  # The number of the layer
num = Number(first_layer_thickness)
num_2 = Number(layer_count)
crv = Curve(curves)
num_3 = Number(layer_thickness)
num_4 = Number(top_layer_thickness)
series = Series(Start=num, Step=num_3, Count=num_2)
python = GhPythonScript(x=num_3, y=num_4)  # -> a
# ---------- python: Python ----------
if y is None or y == 0:
    y = x

a = y
# ---------- end python ----------
lng = ListLength(List=series)
item = ListItem(List=series, Index="-2", Wrap=True)
subtraction = Subtraction(A=lng, B="1")
addition = Addition(A=item, B=python)
subtraction_2 = Subtraction(A=num_2, B="1")
replace = ReplaceItems(List=series, Item=addition, Indices=subtraction, Wrap=False)
bool = Boolean(subtraction_2)
filter = StreamFilter(Gate=bool, Stream0=series, Stream1=replace)
Z = UnitZ(Factor=filter)  # -> graft(UnitVector)
move = Move(Geometry=crv, Motion=Z)  # -> Geometry, Transform
curve = ClusterOutput(move.Geometry)  # Output curve list

# ==== cluster GcodeSolver: Planar curves to Gcode for 3D printing
platform_width = ClusterInput()  # default 250 mm
platform_height = ClusterInput()  # default 250 mm
platform_temperature = ClusterInput()  # default 50 degree
travel_speed = ClusterInput()  # default 100 mm/s
printing_speed_for_first_layer = ClusterInput()  # default 40 mm/s
printing_speed_for_other_layer = ClusterInput()  # default 60 mm/s
line_width = ClusterInput()  # default 0.4 mm
overlapping_ratio = ClusterInput()  # default 15%
material_diameter = ClusterInput()  # default 1.75 mm
nozzle_temprature = ClusterInput()  # default 205 degree
retraction_length = ClusterInput()  # default 0.75 mm
gcode_style = ClusterInput()  # 0 is default, 1 is Klipper
lift_z = ClusterInput()  # default 0 mm
input_curves = ClusterInput()  # Input curves as list
crv = Curve(flatten(input_curves))
num = Number(lift_z)
num_2 = Number(platform_width)
num_3 = Number(platform_height)
num_4 = Number(overlapping_ratio)
num_5 = Number(retraction_length)
num_6 = Number(gcode_style)
num_7 = Number(platform_temperature)
num_8 = Number(travel_speed)
num_9 = Number(printing_speed_for_first_layer)
num_10 = Number(printing_speed_for_other_layer)
num_11 = Number(line_width)
num_12 = Number(material_diameter)
num_13 = Number(nozzle_temprature)
rad = Radians(Degrees="15")
python = GhPythonScript(x=num_2)  # -> a
# ---------- python: Python ----------
__author__ = "littlechao PC"
__version__ = "2023.08.24"

import rhinoscriptsyntax as rs

if x is None:
    x = 250

a = x
# ---------- end python ----------
python_2 = GhPythonScript(x=num_3)  # -> a; same code as python
python_3 = GhPythonScript(x=num_11)  # -> a
# ---------- python_3: Python ----------
__author__ = "littlechao PC"
__version__ = "2023.08.24"

import rhinoscriptsyntax as rs

if x is None:
    x = 0.4

a = x
# ---------- end python_3 ----------
python_4 = GhPythonScript(x=num_4)  # -> a
# ---------- python_4: Python ----------
__author__ = "littlechao PC"
__version__ = "2023.08.24"

import rhinoscriptsyntax as rs

if x is None:
    x = 0.15

a = x
# ---------- end python_4 ----------
python_5 = GhPythonScript(x=num_13)  # -> a
# ---------- python_5: Python ----------
if x is None:
    x = 205

a = x
# ---------- end python_5 ----------
python_6 = GhPythonScript(x=num_12)  # -> a
# ---------- python_6: Python ----------
if x is None:
    x = 1.75

a = x
# ---------- end python_6 ----------
python_7 = GhPythonScript(x=num)  # -> a
# ---------- python_7: Python ----------
if x is None:
    x = 0

a = x
# ---------- end python_7 ----------
python_8 = GhPythonScript(x=num_6)  # -> a
# ---------- python_8: Python ----------
if x is None:
    x = 0
if x > 0:
    x = 1
a = x
# ---------- end python_8 ----------
python_9 = GhPythonScript(x=num_5)  # -> a
# ---------- python_9: Python ----------
if x is None:
    x = 0.75

a = x
# ---------- end python_9 ----------
topoly = CurveToPolyline(Curve=flatten(crv), ToleranceDistance=0, ToleranceAngle=rad)  # -> Polyline, Segments
division = Division(A=python, B="2")
division_2 = Division(A=python_2, B="2")
python_10 = GhPythonScript(x=num_7)  # -> a
# ---------- python_10: Python ----------
__author__ = "littlechao PC"
__version__ = "2023.08.24"

import rhinoscriptsyntax as rs

if x is None:
    x = 50

a = x
# ---------- end python_10 ----------
python_11 = GhPythonScript(x=num_10)  # -> a
# ---------- python_11: Python ----------
__author__ = "littlechao PC"
__version__ = "2023.08.24"

import rhinoscriptsyntax as rs

if x is None:
    x = 60

a = x
# ---------- end python_11 ----------
python_12 = GhPythonScript(x=num_8)  # -> a
# ---------- python_12: Python ----------
__author__ = "littlechao PC"
__version__ = "2023.08.24"

import rhinoscriptsyntax as rs

if x is None:
    x = 100

a = x
# ---------- end python_12 ----------
python_13 = GhPythonScript(x=num_9)  # -> a
# ---------- python_13: Python ----------
__author__ = "littlechao PC"
__version__ = "2023.08.24"

import rhinoscriptsyntax as rs

if x is None:
    x = 40

a = x
# ---------- end python_13 ----------
addition = Addition(A=python_4, B="1")
explode = Explode(Curve=topoly.Polyline, Recursive=True)  # -> Segments, Vertices
python_14 = GhPythonScript(x=python_9)  # -> a
# ---------- python_14: Python ----------
if x != 0:
    x = 1

a = x
# ---------- end python_14 ----------
python_15 = GhPythonScript(x=python_7)  # -> a; same code as python_14
multiplication = Multiplication(A=python_3, B=addition)
pt = ConstructPoint(XCoordinate=division, YCoordinate=division_2, ZCoordinate=0)
len = Length(Curve=explode.Segments)
addition_2 = Addition(A=explode.Vertices, B=pt)
multiplication_2 = Multiplication(A=python_13, B="60")
multiplication_3 = Multiplication(A=python_11, B="60")
multiplication_4 = Multiplication(A=python_12, B="60")
split = SplitList(List=addition_2, Index="1")  # -> ListA, ListB
dom = ConstructDomain(DomainStart=expr("-x", division_2), DomainEnd=division_2)
dom_2 = ConstructDomain(DomainStart=expr("-x", division), DomainEnd=division)
pdecon = Deconstruct(Point=split.ListA)  # -> XComponent, YComponent, ZComponent

cset = CreateSet(List=flatten(pdecon.ZComponent))  # -> Set, Map
cull_i = CullIndex(List=cset.Set, Indices="0", Wrap=True)
cull_i_2 = CullIndex(List=cset.Set, Indices="-1", Wrap=True)
item = ListItem(List=cset.Set, Index=0, Wrap=True)
subtraction = Subtraction(A=cull_i, B=cull_i_2)
ins = InsertItems(List=subtraction, Item=item, Indices="0", Wrap=True)
item_2 = ListItem(List=ins, Index=cset.Map, Wrap=True)  # -> simplify(graft(Item))

lng = ListLength(List=cset.Set)
pdecon_2 = Deconstruct(Point=split.ListB)  # -> XComponent, YComponent, ZComponent
smaller = SmallerThan(FirstNumber=lng, SecondNumber="2")  # -> SmallerThan, OrEqualTo
rectangle = Rectangle(Plane=PlaneXY(0, 0, 0), XSize=dom_2, YSize=dom, Radius=0)  # -> Rectangle, Length
python_16 = GhPythonScript(z=pdecon_2.ZComponent, H=item, f1=multiplication_2, f2=multiplication_3)  # -> a; inputs f1: Int32, f2: Int32
# ---------- python_16: Python ----------
if z > H:
    a = f2
else:
    a = f1
# ---------- end python_16 ----------
filter = StreamFilter(Gate=smaller.SmallerThan, Stream0=item_2, Stream1=cset.Set)
expression = Expression(width=multiplication, high=filter, diameter=python_6, Expression="width*high/(π*(diameter/2)²)")
flatten = FlattenTree(Tree=explode.Segments, Path="{0}")
end = EndPoints(Curve=flatten)  # -> Start, End
cull_i_3 = CullIndex(List=end.Start, Indices="0", Wrap=True)
cull_i_4 = CullIndex(List=end.End, Indices="-1", Wrap=True)
multiplication_5 = Multiplication(A=len, B=expression)
ma = MassAddition(Input=flatten(multiplication_5))  # -> Result, PartialResults
ln = Line(StartPoint=cull_i_4, EndPoint=cull_i_3)
len_2 = Length(Curve=ln)
unflatten = UnflattenTree(Tree=ma.PartialResults, Guide=multiplication_5)

# ---- group: retraction
item_3 = ListItem(List=unflatten, Index=0, Wrap=True)  # -> Item1, Item
subtraction_2 = Subtraction(A=item_3.Item1, B=python_9)
expression_2 = Expression(x=subtraction_2, Expression="Round(x,4)")
format = Format(Format="G1 F2400 E{0}", Culture=127, Data0=expression_2)
gate = StreamGate(Stream=format, Gate=python_14)  # -> Target0, Target1

# ---- group: pre-extrude
num_14 = Number("0.02")
entwine = Entwine(Branch00=num_14, Branch01=item_3.Item1, FlattenInputs=True)  # -> flatten(Result)
cull_i_5 = CullIndex(List=entwine, Indices="-1", Wrap=True)
unflatten_2 = UnflattenTree(Tree=cull_i_5, Guide=item_3.Item1)
expression_3 = Expression(x=unflatten_2, Expression="Round(x,4)")
format_2 = Format(Format="G1 F3600 E{0}", Culture=127, Data0=expression_3)

# ----
ma_2 = MassAddition(Input=len_2)  # -> Result, PartialResults
division_3 = Division(A=len, B=python_16)  # -> flatten(Result)

# ---- group: print
expression_4 = Expression(x=pdecon_2.XComponent, Expression="Round(x,3)")
expression_5 = Expression(x=pdecon_2.YComponent, Expression="Round(x,3)")
expression_6 = Expression(x=unflatten, Expression="Round(x,4)")
format_3 = Format(
    Format="G1 F{0} X{1} Y{2} E{3}",
    Culture=127,
    Data0=python_16,
    Data1=expression_4,
    Data2=expression_5,
    Data3=expression_6)

# ----
ma_3 = MassAddition(Input=division_3)  # -> Result, PartialResults
division_4 = Division(A=ma_2.Result, B=multiplication_4)

# ---- group: lift
addition_3 = Addition(A=pdecon.ZComponent, B=python_7)
format_4 = Format(Format="G0 F3600 Z{0}", Culture=127, Data0=pdecon.ZComponent)

# ---- group: travel
expression_7 = Expression(x=pdecon.XComponent, Expression="Round(x,3)")
expression_8 = Expression(x=pdecon.YComponent, Expression="Round(x,3)")
format_5 = Format(
    Format="G0 F{0} X{1} Y{2} Z{3}",
    Culture=127,
    Data0=multiplication_4,
    Data1=expression_7,
    Data2=expression_8,
    Data3=addition_3)

# ----
addition_4 = Addition(A=division_4, B=ma_3.Result)

# ---- group: print
ins_2 = InsertItems(List=format_3, Item=gate.Target1, Indices="-1", Wrap=True)
clean = CleanTree(RemoveNulls=True, RemoveInvalid=True, RemoveEmpty=True, Tree=ins_2)

# ----
panel = Panel("""PRINT_START EXTRUDER={1} BED={0}
G92 E0
M82
G1 E-0.1 F3600""")
panel_2 = Panel("""M109 S150
M190 S{0}
G92 E0
G28
G28 Z
M109 S{1}
G90
M82
M107
G92 E0
M201 X10000 Y10000 Z3000
G0 X20 Y5 Z0.2 F3600
G1 X220 F3600 E15
G0 Y5.4 F3600
G1 X20 F3000 E30
G0 Z5 F3000
G92 E0
G1 E-0.1 F3600""")
format_6 = Format(Format=panel_2, Culture=127, Data0=python_10, Data1=python_5)

panel_3 = Panel("""0
2
3""")
panel_4 = Panel("""0
1
2
3""")
filter_2 = StreamFilter(Gate=python_15, Stream0=panel_3, Stream1=panel_4)
panel_5 = Panel("""M400
G92 E0
G1 E-10.0 F3600
G91
G0 Z1.0 X20.0 Y20.0 F20000
M104 S0
M140 S0
M107
G1 Z15 F3000
G90""")
weave = Weave(Pattern=filter_2, Stream0=format_5, Stream1=format_4, Stream2=format_2, Stream3=clean, NullGaps=False)
format_7 = Format(Format=panel, Culture=127, Data0=python_10, Data1=python_5)
flatten_2 = FlattenTree(Tree=weave, Path="{0}")
filter_3 = StreamFilter(Gate=python_8, Stream0=panel_5, Stream1="PRINT_END")
filter_4 = StreamFilter(Gate=python_8, Stream0=format_6, Stream1=format_7)
lng_2 = ListLength(List=cset.Set)
entwine_2 = Entwine(Branch00=filter_4, Branch01=flatten_2, Branch02=filter_3, FlattenInputs=True)  # -> flatten(Result)
rec = Rectangle(rectangle.Rectangle)
crv_2 = Curve(flatten)
crv_3 = Curve(ln)
int = Integer(lng_2)
num_15 = Number(addition_4)
platform = ClusterOutput(rec)
printing_path = ClusterOutput(crv_2)
travel_path = ClusterOutput(crv_3)
gcode = ClusterOutput(entwine_2)
layer = ClusterOutput(int)
time = ClusterOutput(num_15)

# ==== cluster LocalPathOptimization: Local path optimization by Greedy Algorithm
input_curve = ClusterInput()  # Input curve as list
crv = Curve(input_curve)
local_road_optimization = LocalRoadOptimization(crv=crv)  # -> opti_curve, min_distance; inputs crv: list of Curve
# ---------- local_road_optimization: Python ----------
import rhinoscriptsyntax as rs

def optimize(crv):
    length = len(crv)
    
    # 预先计算每条曲线的起点和终点
    start_points = [rs.CurveStartPoint(c) for c in crv]
    end_points = [rs.CurveEndPoint(c) for c in crv]
    
    for num in range(length - 1):
        current_end_pt = end_points[num]
        closest_index = num + 1
        min_distance = rs.Distance(current_end_pt, start_points[closest_index])
        
        # 查找最近的曲线
        for i in range(num + 2, length):
            distance = rs.Distance(current_end_pt, start_points[i])
            if distance < min_distance:
                min_distance = distance
                closest_index = i
        
        # 交换位置
        if closest_index != num + 1:
            crv[num + 1], crv[closest_index] = crv[closest_index], crv[num + 1]
            start_points[num + 1], start_points[closest_index] = start_points[closest_index], start_points[num + 1]
            end_points[num + 1], end_points[closest_index] = end_points[closest_index], end_points[num + 1]
    
    return crv

def calculate_empty_road_length(crv):
    empty_len = 0
    for i in range(len(crv) - 1):
        empty_len += rs.Distance(rs.CurveEndPoint(crv[i]), rs.CurveStartPoint(crv[i + 1]))
    return empty_len




# 优化曲线排列
travel_len = calculate_empty_road_length(crv)
optimized_curves = optimize(crv)
opti_travel_len = calculate_empty_road_length(optimized_curves)

# 输出结果
opti_curve = optimized_curves
min_distance = [travel_len, opti_travel_len]
# ---------- end local_road_optimization ----------
crv_2 = Curve(local_road_optimization.opti_curve)
optimial_curve = ClusterOutput(crv_2)  # Optimial curve as list

# ==== cluster Floral: Input a quad mesh, output floral textures
input_mesh = ClusterInput()  # Input quad mesh

# ---- group: 纹理
mesh = Mesh(input_mesh)
crv = Curve([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])
faceb = FaceBoundaries(Mesh=mesh)
medges = MeshEdges(Mesh=mesh)  # -> NakedEdges, InteriorEdges, NonManifoldEdges
bbox = BoundingBox(Content=crv, Plane=PlaneXY(0, 0, 0), UnionBox=True)  # -> Box, Box_2
debox = DeconstructBox(Box=bbox.Box)  # -> Plane, X, Y, Z
rectangle = Rectangle(Plane=PlaneXY(0, 0, 0), XSize=debox.X, YSize=debox.Y, Radius=0)  # -> Rectangle, Length
map_srf = MapToSurface(Curve=crv, Source=rectangle.Rectangle, Target=graft(faceb))  # -> flatten(Curve)
join = JoinCurves(Curves=medges.NakedEdges, Preserve=False)
join_2 = JoinCurves(Curves=map_srf, Preserve=False)
merge = Merge(Data1=join, Data2=join_2)
crv_2 = Curve(merge)

# ----
output_curve_texture = ClusterOutput(crv_2)  # Curves as list

# ==== cluster Truss: Input a quad mesh, output truss textures
input_mesh = ClusterInput()  # Input quad mesh

# ---- group: 纹理
mesh = Mesh(input_mesh)
faceb = FaceBoundaries(Mesh=mesh)
crv = Curve([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])
cpoly = ControlPolygon(Curve=crv)  # -> Polygon, flatten(Points)
medges = MeshEdges(Mesh=mesh)  # -> NakedEdges, InteriorEdges, NonManifoldEdges
bnd = Bounds2D(Coordinates=cpoly.Points)
dedom2 = DeconstructDomain²(Domain=bnd)  # -> UComponent, VComponent
rectangle = Rectangle(Plane=PlaneXY(0, 0, 0), XSize=dedom2.UComponent, YSize=dedom2.VComponent, Radius=0)  # -> Rectangle, Length
map_srf = MapToSurface(Curve=crv, Source=rectangle.Rectangle, Target=graft(faceb))  # -> flatten(Curve)
join = JoinCurves(Curves=medges.NakedEdges, Preserve=False)
join_2 = JoinCurves(Curves=map_srf, Preserve=False)
merge = Merge(Data1=join, Data2=join_2)
crv_2 = Curve(merge)

# ----
output_curve_texture = ClusterOutput(crv_2)  # Curves as list

# ==== cluster Sprial: Input a quad mesh, output spiral textures as curves
input_mesh = ClusterInput()  # Input quad mesh

# ---- group: 纹理
mesh = Mesh(input_mesh)
crv = Curve([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])
faceb = FaceBoundaries(Mesh=mesh)
cpoly = ControlPolygon(Curve=crv)  # -> Polygon, flatten(Points)
medges = MeshEdges(Mesh=mesh)  # -> NakedEdges, InteriorEdges, NonManifoldEdges
bnd = Bounds2D(Coordinates=cpoly.Points)
dedom2 = DeconstructDomain²(Domain=bnd)  # -> UComponent, VComponent
rectangle = Rectangle(Plane=PlaneXY(0, 0, 0), XSize=dedom2.UComponent, YSize=dedom2.VComponent, Radius=0)  # -> Rectangle, Length
map_srf = MapToSurface(Curve=crv, Source=rectangle.Rectangle, Target=graft(faceb))  # -> flatten(Curve)
join = JoinCurves(Curves=medges.NakedEdges, Preserve=False)
join_2 = JoinCurves(Curves=map_srf, Preserve=False)
merge = Merge(Data1=join, Data2=join_2)
crv_2 = Curve(merge)

# ----
output_curve_texture = ClusterOutput(crv_2)  # Curves as list

# ==== cluster Coin: Input a quad mesh, output coin textures
input_mesh = ClusterInput()  # Input quad mesh

# ---- group: 纹理
mesh = Mesh(input_mesh)
faceb = FaceBoundaries(Mesh=mesh)
crv = Curve([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])
cpoly = ControlPolygon(Curve=crv)  # -> Polygon, flatten(Points)
medges = MeshEdges(Mesh=mesh)  # -> NakedEdges, InteriorEdges, NonManifoldEdges
bnd = Bounds2D(Coordinates=cpoly.Points)
dedom2 = DeconstructDomain²(Domain=bnd)  # -> UComponent, VComponent
rectangle = Rectangle(Plane=PlaneXY(0, 0, 0), XSize=dedom2.UComponent, YSize=dedom2.VComponent, Radius=0)  # -> Rectangle, Length
map_srf = MapToSurface(Curve=crv, Source=rectangle.Rectangle, Target=graft(faceb))  # -> flatten(Curve)
join = JoinCurves(Curves=medges.NakedEdges, Preserve=False)
join_2 = JoinCurves(Curves=map_srf, Preserve=False)
merge = Merge(Data1=join, Data2=join_2)
crv_2 = Curve(merge)

# ----
output_curve_texture = ClusterOutput(crv_2)  # Curves as list

# ==== cluster TriAuxeticStructure: Input a contour curve, output the tri-auxetic structure as curves
offset_width = ClusterInput()  # The offset distance of the triangle
contour_curve = ClusterInput()  # Input a contour curve
offset_count = ClusterInput()  # The offset count of the triangle
scale_factor = ClusterInput()  # The gap rate between adjacent triangles
unit_size = ClusterInput()  # The edge length of the unit triangle
fillet = ClusterInput()  # Hinge feillet
crv = Curve(contour_curve)
num = Number(unit_size)
num_2 = Number(scale_factor)
num_3 = Number(fillet)
num_4 = Number(offset_width)
num_5 = Number(offset_count)

bbox = BoundingBox(Content=crv, Plane=PlaneXY(0, 0, 0))  # -> Box, Box_2
number_slider = Slider(1.05, range=1..1.5)
debox = DeconstructBox(Box=bbox.Box)  # -> Plane, X, Y, Z
dedomain = DeconstructDomain(Domain=debox.X)  # -> Start, End
dedomain_2 = DeconstructDomain(Domain=debox.Y)  # -> Start, End
multiplication = Multiplication(A=dedomain.Start, B=number_slider)
multiplication_2 = Multiplication(A=dedomain.End, B=number_slider)
multiplication_3 = Multiplication(A=dedomain_2.Start, B=number_slider)
multiplication_4 = Multiplication(A=dedomain_2.End, B=number_slider)
pt = ConstructPoint(XCoordinate=multiplication, YCoordinate=multiplication_3, ZCoordinate=0)
subtraction = Subtraction(A=multiplication_2, B=multiplication)
subtraction_2 = Subtraction(A=multiplication_4, B=multiplication_3)
expression = Expression(s=num, h=subtraction_2, Expression="h*2/(Sqrt(3)*s)")
expression_2 = Expression(s=num, w=subtraction, Expression="(w/s-0.5)/0.5")
trigrid = Triangular(Plane=pt, Size=num, ExtentX=expression_2, ExtentY=expression)  # -> Cells, Points

series = Series(Start=num_4, Step=num_4, Count=num_5)

python = GhPythonScript(treecells=trigrid.Cells)  # -> a; inputs treecells: tree of Curve
# ---------- python: Python ----------
__author__ = "littlechao PC"
__version__ = "2024.08.18"

import rhinoscriptsyntax as rs
import Rhino.Geometry as rg

def reverse1(treecells):
    for i in range(treecells.BranchCount):
        list_len = len(treecells.Branches[i])
        if i % 2 == 0:
            for j in range(list_len):
                if j % 2 == 0:
                    treecells.Branches[i][j].Reverse()
        else:
            for j in range(list_len):
                if j % 2 == 1:
                    treecells.Branches[i][j].Reverse()
    return treecells


#def reverse2(treecells):
#    for i in range(treecells.BranchCount):
#        list_len = len(treecells.Branches[i])
#        if i % 2 == 0:
#            for j in range(list_len):
#                if (j // 2) % 2 == 0:
#                    treecells.Branches[i][j].Reverse()
#        else:
#            for j in range(list_len):
#                if (j // 2) % 2 == 1:
#                    treecells.Branches[i][j].Reverse()
#    return treecells


a = reverse1(treecells)
# ---------- end python ----------
pcen = PolygonCenter(Polyline=python)  # -> CenterV, CenterE, CenterA
incurve = PointInCurve(Point=pcen.CenterV, Curve=crv)  # -> Relationship, Point
dispatch = Dispatch(List=python, DispatchPattern=incurve.Relationship)  # -> ListA, ListB
crv_2 = Curve(dispatch.ListA)

pcen_2 = PolygonCenter(Polyline=crv_2)  # -> CenterV, CenterE, CenterA
subtraction_3 = Subtraction(A="1", B=num_2)
division = Division(A=num, B="3")
explode = Explode(Curve=crv_2, Recursive=True)  # -> Segments, Vertices
scale = Scale(Geometry=crv_2, Center=pcen_2.CenterV, Factor=num_2)  # -> Geometry, Transform
multiplication_5 = Multiplication(A=subtraction_3, B=division)
disc = Discontinuity(Curve=scale.Geometry, Level=1)  # -> Points, Parameters
eval = EvaluateCurve(Curve=explode.Segments, Parameter=multiplication_5)  # -> Point, Tangent, Angle
shift = ShiftList(List=disc.Points, Shift="2", Wrap=True)
trim = TrimTree(Tree=shift, Depth=1)
ln = Line(StartPoint=eval.Point, EndPoint=trim)  # -> flatten(Line)
neg = Negative(Value=series)  # -> graft(Result)
join = JoinCurves(Curves=ln, Preserve=False)
offset = OffsetCurve(Curve=flatten(scale.Geometry), Distance=neg, Corners=1)
python_2 = GhPythonScript(x=join)  # -> a, b; inputs x: list of Curve
# ---------- python_2: Python ----------
__author__ = "littlechao PC"
__version__ = "2024.08.19"

import rhinoscriptsyntax as rs

polylines = []
lines = []
for i in range(len(x)):
    if rs.IsLine(x[i]) is not True:
        polylines.append(x[i])
    else:
        lines.append(x[i])


a = polylines
b = lines
# ---------- end python_2 ----------
fillet_2 = Fillet(Curve=python_2.a, Radius=num_3)
entwine = Entwine(Branch00=fillet_2, Branch01=python_2.b, Branch02=offset, FlattenInputs=True)  # -> flatten(Result)
crv_3 = Curve(entwine)
output_curves = ClusterOutput(crv_3)  # Output auxetic curves

# ==== cluster QuadAuxeticStructure: Input a contour curve, output the quad-auxetic structure as curves
offset_width = ClusterInput()  # The offset distance of the rectangle
offset_count = ClusterInput()  # The offset count of the rectangle
scale_factor = ClusterInput()  # The gap rate between adjacent rectangles
contour_curve = ClusterInput()  # Input a contour curve
unit_size = ClusterInput()  # The edge length of the unit triangle
crv = Curve(contour_curve)
num = Number(unit_size)
int = Integer(offset_count)
num_2 = Number(scale_factor)
num_3 = Number(offset_width)
series = Series(Start=num_3, Step=num_3, Count=int)

bbox = BoundingBox(Content=crv, Plane=PlaneXY(0, 0, 0))  # -> Box, Box_2
number_slider = Slider(1.05, range=1..1.5)
debox = DeconstructBox(Box=bbox.Box)  # -> Plane, X, Y, Z
dedomain = DeconstructDomain(Domain=debox.X)  # -> Start, End
dedomain_2 = DeconstructDomain(Domain=debox.Y)  # -> Start, End
multiplication = Multiplication(A=dedomain.Start, B=number_slider)
multiplication_2 = Multiplication(A=dedomain.End, B=number_slider)
multiplication_3 = Multiplication(A=dedomain_2.Start, B=number_slider)
multiplication_4 = Multiplication(A=dedomain_2.End, B=number_slider)
pt = ConstructPoint(XCoordinate=multiplication, YCoordinate=multiplication_3, ZCoordinate=0)
subtraction = Subtraction(A=multiplication_2, B=multiplication)
subtraction_2 = Subtraction(A=multiplication_4, B=multiplication_3)
division = Division(A=subtraction, B=num)
division_2 = Division(A=subtraction_2, B=num)
sqgrid = Square(Plane=pt, Size=num, ExtentX=division, ExtentY=division_2)  # -> Cells, Points

num_4 = Number(Slider(1, range=0..1))
python = GhPythonScript(treecells=sqgrid.Cells)  # -> a, b; inputs treecells: tree of Curve
# ---------- python: Python ----------
__author__ = "littlechao PC"
__version__ = "2024.08.18"

import rhinoscriptsyntax as rs
import Rhino.Geometry as rg
import Grasshopper.DataTree as DataTree
from Grasshopper.Kernel.Data import GH_Path



def reverse1(treecells):
    bools = DataTree[object]()
    paths = treecells.Paths
    
    for i in range(treecells.BranchCount):
        list_len = len(treecells.Branches[i])
        bool = []
        if i % 2 == 0:
            for j in range(list_len):
                if j % 2 == 0:
                    treecells.Branches[i][j].Reverse()
                    bools.Add(False, paths[i])
                else: bools.Add(True, paths[i])
        else:
            for j in range(list_len):
                if j % 2 == 1:
                    treecells.Branches[i][j].Reverse()
                    bools.Add(False, paths[i])
                else: bools.Add(True, paths[i])
    return treecells, bools


#def reverse2(treecells):
#    for i in range(treecells.BranchCount):
#        list_len = len(treecells.Branches[i])
#        if i % 2 == 0:
#            for j in range(list_len):
#                if (j // 2) % 2 == 0:
#                    treecells.Branches[i][j].Reverse()
#        else:
#            for j in range(list_len):
#                if (j // 2) % 2 == 1:
#                    treecells.Branches[i][j].Reverse()
#    return treecells

tree, bools = reverse1(treecells)
a = tree
b = bools
# ---------- end python ----------
pcen = PolygonCenter(Polyline=python.a)  # -> CenterV, CenterE, CenterA
incurve = PointInCurve(Point=pcen.CenterV, Curve=crv)  # -> Relationship, Point
dispatch = Dispatch(List=python.a, DispatchPattern=incurve.Relationship)  # -> ListA, ListB
dispatch_2 = Dispatch(List=python.b, DispatchPattern=incurve.Relationship)  # -> ListA, ListB
crv_2 = Curve(dispatch.ListA)
pcen_2 = PolygonCenter(Polyline=crv_2)  # -> CenterV, CenterE, CenterA
subtraction_3 = Subtraction(A="1", B=num_2)
division_3 = Division(A=num, B="2")
rad = Radians(Degrees=Slider(5, range=0..100))
explode = Explode(Curve=crv_2, Recursive=True)  # -> Segments, Vertices
scale = Scale(Geometry=crv_2, Center=pcen_2.CenterV, Factor=num_2)  # -> Geometry, Transform
sin = Sine(Value=rad)
multiplication_5 = Multiplication(A=division_3, B=subtraction_3)
python_2 = GhPythonScript(x=dispatch_2.ListA, y=rad)  # -> a
# ---------- python_2: Python ----------
if x:
    a = y
else:
    a = -y
# ---------- end python_2 ----------
multiplication_6 = Multiplication(A=sin, B=num, C=Slider(0.42, range=0..1))
addition = Addition(A=multiplication_5, B=multiplication_6)
rotate = Rotate(Geometry=scale.Geometry, Angle=python_2, Plane=pcen_2.CenterV)  # -> Geometry, Transform
disc = Discontinuity(Curve=rotate.Geometry, Level=1)  # -> Points, Parameters
shift = ShiftList(List=disc.Points, Shift="3", Wrap=True)
eval = EvaluateCurve(Curve=explode.Segments, Parameter=addition)  # -> Point, Tangent, Angle
trim = TrimTree(Tree=shift, Depth=1)
ln = Line(StartPoint=eval.Point, EndPoint=trim)
neg = Negative(Value=series)  # -> graft(Result)
join = JoinCurves(Curves=flatten(ln), Preserve=False)
offset = OffsetCurve(Curve=flatten(rotate.Geometry), Distance=neg, Corners=1)
python_3 = GhPythonScript(x=join)  # -> a, b; inputs x: list of Curve; same code as python_2
fillet = Fillet(Curve=python_3.a, Radius=num_4)
entwine = Entwine(Branch00=fillet, Branch01=python_3.b, Branch02=offset, FlattenInputs=True)  # -> flatten(Result)
crv_3 = Curve(entwine)
output_curves = ClusterOutput(crv_3)  # Output auxetic curves

# ==== cluster WavyStructure: Input a quad mesh, output the wavy structure as curves
input_mesh = ClusterInput()  # Input quad mesh

# ---- group: 纹理
mesh = Mesh(input_mesh)
faceb = FaceBoundaries(Mesh=mesh)
crv = Curve([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])
cpoly = ControlPolygon(Curve=crv)  # -> Polygon, flatten(Points)
medges = MeshEdges(Mesh=mesh)  # -> NakedEdges, InteriorEdges, NonManifoldEdges
bnd = Bounds2D(Coordinates=cpoly.Points)
dedom2 = DeconstructDomain²(Domain=bnd)  # -> UComponent, VComponent
rectangle = Rectangle(Plane=PlaneXY(0, 0, 0), XSize=dedom2.UComponent, YSize=dedom2.VComponent, Radius=0)  # -> Rectangle, Length
map_srf = MapToSurface(Curve=crv, Source=rectangle.Rectangle, Target=graft(faceb))  # -> flatten(Curve)
join = JoinCurves(Curves=medges.NakedEdges, Preserve=False)
join_2 = JoinCurves(Curves=map_srf, Preserve=False)
merge = Merge(Data1=join, Data2=join_2)
crv_2 = Curve(merge)

# ----
output_curve_texture = ClusterOutput(crv_2)  # Curves as list

# ==== cluster Cluster
contour_curve = ClusterInput()  # Input a contour curve
target_count = ClusterInput()  # Number of quads for aim in the result
attractive_point = ClusterInput()  # Input attractive points
factor = ClusterInput()  # Attractive factor from 0 to 1
crv = Curve(contour_curve)
int = Integer(target_count)
pt = Point(attractive_point)
brep = Brep(crv)
num = Number(factor)
qrsettings = QuadRemeshSettings(TargetCount=int, AdaptiveSize=0, AdaptiveCount=False, HardEdges=False, SeamEdges=0, Symmetry=0, GuideCurves=0)
qrmesh = QuadRemesh(Mesh=brep, Settings=qrsettings)
medges = MeshEdges(Mesh=qrmesh)  # -> NakedEdges, InteriorEdges, NonManifoldEdges
demesh = DeconstructMesh(Mesh=qrmesh)  # -> Vertices, Faces, Colours, Normals
join = JoinCurves(Curves=medges.NakedEdges, Preserve=False)
ln = Line(StartPoint=demesh.Vertices, EndPoint=graft(pt))
python = GhPythonScript(x=pt)  # -> a; inputs x: list of Point3d
# ---------- python: Python ----------
if len(x) == 0:
    a = False
else:
    a = True
# ---------- end python ----------
pull = PullPoint(Point=demesh.Vertices, Geometry=join, ClosestOnly=True)  # -> ClosestPoint, Distance
flip = FlipMatrix(Data=ln)
bnd = Bounds(Numbers=pull.Distance)
len = Length(Curve=flip)
remap = RemapNumbers(Value=pull.Distance, Source=bnd, Target=Domain(0, 1))  # -> Mapped, Clipped
sort = SortList(Keys=len, ValuesA=flip)  # -> Keys, ValuesA
graph = GraphMapper(remap.Mapped, x0=0, x1=1, y0=0, y1=1, container_name="Bezier", cpx=[0, 0, 0.6231879592, 1], cpy=[0, 0.4149753451, 1, 1])
item = ListItem(List=sort.ValuesA, Index=0, Wrap=True)
trim = TrimTree(Tree=item, Depth=1)
multiplication = Multiplication(A=remap.Mapped, B=num)
python_2 = GhPythonScript(x=remap.Mapped, y=multiplication)  # -> out, a
# ---------- python_2: Python ----------
if x > 0.001:
    a = y
else:
    a = 0
# ---------- end python_2 ----------
eval = EvaluateCurve(Curve=reparameterize(trim), Parameter=python_2.a)  # -> Point, Tangent, Angle
eval_2 = EvaluateCurve(Curve=reparameterize(flip), Parameter=graft(python_2.a))  # -> Point, Tangent, Angle
avr = Average(Input=eval_2.Point)  # -> flatten(ArithmeticMean)
ln_2 = Line(StartPoint=eval.Point, EndPoint=avr)
midpt = CurveMiddle(Curve=ln_2)
conmesh = ConstructMesh(Vertices=midpt, Faces=demesh.Faces)
filter = StreamFilter(Gate=python, Stream0=qrmesh, Stream1=conmesh)
mesh = Mesh(filter)
quad_mesh = ClusterOutput(mesh)  # Output quad mesh
