# Grasshopper definition guide.gh (Grasshopper 1.0.7)
# plug-ins: Kangaroo2 Components

# ----
# Draw curves textures as Structures
# The order of the curves is random, before generation of the GCode, need to path optimization
crv = Curve([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])
crv_2 = Curve([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])
# Fast but not shortest path
lpath_optimization = LocalPathOptimization(input_curve=crv)
# slow but shortest path
gpath_optimization = GlobalPathOptimization()  # -> optimial_curve, min_length, iteration
pgcoder = PlanarGCoder(
    input_curve=lpath_optimization,
    platform_width=Slider(250, range=0..1000),
    platform_height=Slider(250, range=0..1000),
    printing_speed=Slider(40, range=0..100),
    printing_width=Slider(0.4, range=0..1),
    printing_height=Slider(0.2, range=0..1),
    nozzle_temperature=Slider(205, range=0..1000),
    platform_temperature=Slider(60, range=0..100))  # -> gcode, layer, printing_time
export = ExportGCode(gcode_text=pgcoder.gcode, path_folder="D:\printing\Gocde", file_name="test2", update=Button())

number_slider = Slider(7, range=0..10)
crv_3 = Curve(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)
mesh_uv = MeshSurface(Surface=crv_3, UCount=number_slider, VCount=number_slider, Overhang=True, Equalize=False)
triremesh = TriRemesh(Geometry=mesh_uv, Length="5", Iterations=25)  # -> Triangulation, Dual, Creases
diag = Diagonalize(Mesh=triremesh.Triangulation)
medges = MeshEdges(Mesh=diag)  # -> NakedEdges, InteriorEdges, NonManifoldEdges
line = Line([medges.NakedEdges, medges.InteriorEdges])
join = JoinCurves(Curves=line, Preserve=False)

crv_4 = Curve(join)

# ----
# Custom Generate structure
# FreeSlicer can seamlessly docking with parameteric design to implement advaned design needs.
lpath_optimization_2 = LocalPathOptimization(input_curve=crv_4)
gpath_optimization_2 = GlobalPathOptimization()  # -> optimial_curve, min_length, iteration
pgcoder_2 = PlanarGCoder(
    input_curve=lpath_optimization_2,
    platform_width=Slider(250, range=0..1000),
    platform_height=Slider(250, range=0..1000),
    printing_speed=Slider(40, range=0..100),
    printing_width=Slider(0.4, range=0..1),
    printing_height=Slider(0.2, range=0..1),
    nozzle_temperature=Slider(205, range=0..1000),
    platform_temperature=Slider(60, range=0..100))  # -> gcode, layer, printing_time
export_2 = ExportGCode(gcode_text=pgcoder_2.gcode, path_folder="D:\printing\Gocde", file_name="test3", update=Button())

# ---- group: click save as file
button = Button()

# ----
# FreeSlicer is a 3D printing plugin in Grasshopper, designers can draw or generate curves and then convert them into GCode commands directly. FreeSlicer focuses on the flat materials generation by 3D printing, and also suitable to the general 3D printing through docking with parametric design.
# 
# FreeSlicer Install
# 1. Open Rhino and open Grasshopper.
# 2. In Grasshopper, click "File" -> "Special Folders" -> "User Object Folder".
# 3. take "FreeSlicer_V0.01" folder into "UseObjects" folder.
# Draw One curve
crv_5 = Curve(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)
pgcoder_3 = PlanarGCoder(
    input_curve=crv_5,
    platform_width=Slider(250, range=0..1000),
    platform_height=Slider(250, range=0..1000),
    printing_speed=Slider(40, range=0..100),
    printing_width=Slider(0.4, range=0..1),
    printing_height=Slider(0.2, range=0..1),
    nozzle_temperature=Slider(205, range=0..1000),
    platform_temperature=Slider(60, range=0..100))  # -> gcode, layer, printing_time
export_3 = ExportGCode(gcode_text=pgcoder_3.gcode, path_folder="D:\printing\Gocde", file_name="test1", update=button)

# ----
# Process Visualization
number_slider_2 = Slider(1, range=0..1)
crv_6 = Curve([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])
lpath_optimization_3 = LocalPathOptimization(input_curve=crv_6)
vis_process = ProcessVisualization(input_curve=lpath_optimization_3, printing_process=number_slider_2)  # -> visual_curve, nozzle

# ----
# Preview Printing Result
crv_7 = Curve([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])
lpath_optimization_4 = LocalPathOptimization(input_curve=crv_7)
print_preview = PrintPreview(input_curve=lpath_optimization_4, printing_width=Slider(0.4, range=0..1), printing_height=Slider(0.2, range=0..1))

# ----
# Generate Filling Path
# A variety of filling texture can be generated, and not need to optimization.
crv_8 = Curve(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)
fcpath = FillCrossPath(
    region=crv_8,
    rotate_cross_line=Slider(35, range=0..180),
    cross_line_angle=Slider(90, range=0..90),
    cross_line_gap=Slider(0.5, range=0..10),
    cross_line_height=Slider(0.3, range=0..10),
    printing_layer=Slider(2, range=0..10))  # -> cross_line, layer_count

# ==== cluster PlanarGCoder: Planar curves to GCode
platform_temperature = ClusterInput()  # Platform temperature default 60
input_curve = ClusterInput()  # Input curve as list
platform_width = ClusterInput()  # Platform width of the 3D printer default 250
printing_width = ClusterInput()  # Printing width default 0.2
printing_height = ClusterInput()  # Printing height default 0.2
nozzle_temperature = ClusterInput()  # Nozzle temperature for material PLA(205), TPU(225)
is_pumpback = ClusterInput()  # True Pumpback (default True)
platform_height = ClusterInput()  # Platform height of the 3D printer default 250
max_speed = ClusterInput()  # Max move speed of the nozzle default 100 (mm/s)
printing_speed = ClusterInput()  # Printing speed of the nozzle default 40 (mm/min)
crv = Curve(input_curve)
num = Number(platform_width)
num_2 = Number(max_speed)
num_3 = Number(printing_speed)
num_4 = Number(printing_width)
num_5 = Number(printing_height)
num_6 = Number(platform_temperature)
bool = Boolean(is_pumpback)
num_7 = Number(platform_height)
num_8 = Number(nozzle_temperature)
end = EndPoints(Curve=crv)  # -> Start, End
python = GhPythonScript(x=num)  # -> a
# ---------- python: Python ----------
__author__ = "littlechao PC"
__version__ = "2023.08.24"

import rhinoscriptsyntax as rs

if x is None:
    x = 250

a = x
# ---------- end python ----------
python_2 = GhPythonScript(x=num_7)  # -> a; same code as python
python_3 = GhPythonScript(x=num_4)  # -> a
# ---------- python_3: Python ----------
__author__ = "littlechao PC"
__version__ = "2023.08.24"

import rhinoscriptsyntax as rs

if x is None:
    x = 0.2

a = x
# ---------- end python_3 ----------
python_4 = GhPythonScript(x=num_5)  # -> a; same code as python_3
topoly = CurveToPolyline(Curve=flatten(crv), ToleranceDistance="1", ToleranceAngle=0, MinEdge="1")  # -> Polyline, Segments
python_5 = GhPythonScript(x=num_2)  # -> a
# ---------- python_5: Python ----------
__author__ = "littlechao PC"
__version__ = "2023.08.24"

import rhinoscriptsyntax as rs

if x is None:
    x = 100

a = x
# ---------- end python_5 ----------
python_6 = GhPythonScript(x=num_3)  # -> a
# ---------- python_6: Python ----------
__author__ = "littlechao PC"
__version__ = "2023.08.24"

import rhinoscriptsyntax as rs

if x is None:
    x = 40

a = x
# ---------- end python_6 ----------
division = Division(A=python, B="2")
division_2 = Division(A=python_2, B="2")
python_7 = GhPythonScript(x=num_8)  # -> a
# ---------- python_7: Python ----------
__author__ = "littlechao PC"
__version__ = "2023.08.24"

import rhinoscriptsyntax as rs

if x is None:
    x = 205

a = x
# ---------- end python_7 ----------
python_8 = GhPythonScript(x=num_6)  # -> a
# ---------- python_8: Python ----------
__author__ = "littlechao PC"
__version__ = "2023.08.24"

import rhinoscriptsyntax as rs

if x is None:
    x = 60

a = x
# ---------- end python_8 ----------
python_9 = GhPythonScript(x=bool)  # -> a
# ---------- python_9: Python ----------
__author__ = "littlechao PC"
__version__ = "2023.08.24"

import rhinoscriptsyntax as rs

if x is None:
    x = True

a = x
# ---------- end python_9 ----------
cull_i = CullIndex(List=end.Start, Indices="0", Wrap=True)
cull_i_2 = CullIndex(List=end.End, Indices="-1", Wrap=True)
expression = Expression(width=python_3, high=python_4, diameter="1.75", Expression="width*high/(π*(diameter/2)²)")
explode = Explode(Curve=topoly.Polyline, Recursive=True)  # -> Segments, Vertices
pt = ConstructPoint(XCoordinate=division, YCoordinate=division_2, ZCoordinate=0)
ln = Line(StartPoint=cull_i_2, EndPoint=cull_i)
len = Length(Curve=explode.Segments)
len_2 = Length(Curve=ln)
ma = MassAddition(Input=flatten(len))  # -> Result, PartialResults
addition = Addition(A=explode.Vertices, B=pt)
ma_2 = MassAddition(Input=len_2)  # -> Result, PartialResults
unflatten = UnflattenTree(Tree=ma.PartialResults, Guide=len)
split = SplitList(List=addition, Index="1")  # -> ListA, ListB
multiplication = Multiplication(A=python_5, B="60")
multiplication_2 = Multiplication(A=python_6, B="60")
multiplication_3 = Multiplication(A=unflatten, B=expression)

item = ListItem(List=multiplication_3, Index=0, Wrap=True)  # -> Item1, Item
subtraction = Subtraction(A=item.Item1, B="1.5")
expression_2 = Expression(x=subtraction, Expression="Round(x,4)")
format = Format(Format="G1 F2400 E{0}", Culture=127, Data0=expression_2)
gate = StreamGate(Stream=format, Gate=python_9)  # -> Target0, Target1

num_9 = Number("0.02")
entwine = Entwine(Branch00=num_9, Branch01=item.Item1, FlattenInputs=True)  # -> flatten(Result)
cull_i_3 = CullIndex(List=entwine, Indices="-1", Wrap=True)
unflatten_2 = UnflattenTree(Tree=cull_i_3, Guide=item.Item1)
expression_3 = Expression(x=unflatten_2, Expression="Round(x,4)")
format_2 = Format(Format="G1 F2400 E{0}", Culture=127, Data0=expression_3)

pdecon = Deconstruct(Point=split.ListA)  # -> XComponent, YComponent, ZComponent
expression_4 = Expression(x=pdecon.XComponent, Expression="Round(x,3)")
expression_5 = Expression(x=pdecon.YComponent, Expression="Round(x,3)")
format_3 = Format(Format="G0 F{0} X{1} Y{2}", Culture=127, Data0=multiplication, Data1=expression_4, Data2=expression_5)

division_3 = Division(A=ma_2.Result, B=multiplication)
division_4 = Division(A=ma.Result, B=multiplication_2)

pdecon_2 = Deconstruct(Point=split.ListB)  # -> XComponent, YComponent, ZComponent
expression_6 = Expression(x=pdecon_2.XComponent, Expression="Round(x,3)")
expression_7 = Expression(x=pdecon_2.YComponent, Expression="Round(x,3)")
expression_8 = Expression(x=multiplication_3, Expression="Round(x,4)")
format_4 = Format(
    Format="G1 F{0} X{1} Y{2} E{3}",
    Culture=127,
    Data0=multiplication_2,
    Data1=expression_6,
    Data2=expression_7,
    Data3=expression_8)

addition_2 = Addition(A=division_3, B=division_4)

ins = InsertItems(List=format_4, Item=gate.Target1, Indices="-1", Wrap=True)
clean = CleanTree(RemoveNulls=True, RemoveInvalid=True, RemoveEmpty=True, Tree=ins)

num_10 = Number(flatten(pdecon.ZComponent))
panel = Panel(num_10)
weave = Weave(Pattern=[0, 1, 2], Stream0=format_3, Stream1=format_2, Stream2=clean, NullGaps=False)
python_10 = GhPythonScript(x=panel)  # -> out, a; inputs x: list
# ---------- python_10: Python ----------
import rhinoscriptsyntax as rs

shift = []
for i in x:
    shift.append(i)
shift.remove(shift[-1])
x.remove(x[0])
print shift
print x

path = []
path.append('{0;0}')
branch = 0
root = 0
for j in range(len(x)):
    if x[j] == shift[j]:
        str = '{%d;%d}' %(root, branch+1)
        branch += 1
        path.append(str)
    else:
        root += 1
        branch = 0
        str = '{%d;%d}' %(root, branch)
        path.append(str)

a = path
# ---------- end python_10 ----------
tstat = TreeStatistics(Tree=weave)  # -> Paths, Length, Count
replace = ReplacePaths(Data=weave, Search=tstat.Paths, Replace=python_10.a)

panel_2 = Panel("""M140 S{1}
M104 T0 S{0}
M109 T0 S{0}
T0
M190 S{1}""")
format_5 = Format(Format=panel_2, Culture=127, Data0=python_7, Data1=python_8)
panel_3 = Panel("""M221 T0 S100.00
G21
G90
M82
M107
G28 X0 Y0
G28 Z0
G1 Z15.0 F300
G92 E0
G1 F140 E29
G1 X20 Y0 F140 E30
G92 E0
G1 F6000.0
M117 Printing...
M1001
M106 S0
G1 F2400 E-1.5000
M204 S500.00""")
ins_2 = InsertItems(List=panel_3, Item=format_5, Indices="1", Wrap=True)

trim = TrimTree(Tree=replace, Depth=1)
tstat_2 = TreeStatistics(Tree=trim)  # -> Paths, Length, Count
series = Series(Start="1", Step=1, Count=tstat_2.Count)  # -> graft(Series)
multiplication_4 = Multiplication(A=series, B=python_4)
expression_9 = Expression(x=multiplication_4, Expression="Round(x,3)")
panel_4 = Panel("""G0 F300 Z5.300
G0 F6000 X50.0 Y50.0
M221 T0 S100
G92 E0
M1002
M104 T0 S0
M221 T0 S100
M104 S0
M140 S0
M107
G91
G1 E-1 F300
G1 Z+0.5 E-5 X-20 Y-20 F9000.00
G28 X0 Y0
M84
G90""")
format_6 = Format(Format="G0 F300 Z{0}", Culture=127, Data0=expression_9)
ins_3 = InsertItems(List=trim, Item=format_6, Indices="1", Wrap=True)  # -> flatten(List)
entwine_2 = Entwine(Branch00=ins_2, Branch01=ins_3, Branch02=panel_4, FlattenInputs=True)  # -> flatten(Result)
num_11 = Number(addition_2)
int = Integer(tstat_2.Count)
gcode = ClusterOutput(entwine_2)  # Output GCode
layer = ClusterOutput(int)  # Printing Layer
printing_time = ClusterOutput(num_11)  # Printing time

# ==== cluster ExportGCode: Export GCode
path_folder = ClusterInput()  # Export address
file_name = ClusterInput()  # File name
gcode_text = ClusterInput()  # Input GCode text
update = ClusterInput()  # Update file
txt = Text(path_folder)
txt_2 = Text(file_name)
bool = Boolean(update)
txt_3 = Text(gcode_text)
export = ExportFile(gcode=txt_3, path=txt, name=txt_2, update=bool)  # inputs gcode: list, update: Boolean
# ---------- export: Python ----------
__author__ = "littlechao PC"
__version__ = "2023.07.08"

import rhinoscriptsyntax as rs

if name is None:
    name = 'gh_gcode'

file = '\{n}.gcode'.format(n=name)
path = path + file
if update is True:
    with open(path, 'w') as f:
        for line in gcode:
            f.writelines(line)
            f.write('\n')
# ---------- end export ----------

# ==== cluster LocalPathOptimization: Local path optimization by Greedy Algorithm
input_curve = ClusterInput()  # Input curve as list
crv = Curve(input_curve)
local_road_optimization = LocalRoadOptimization(crv=crv)  # -> out, opti_curve; inputs crv: list of Curve
# ---------- local_road_optimization: Python ----------
import rhinoscriptsyntax as rs
import copy

def indexofMin(arr):
    minindex = 0
    currentindex = 1
    while currentindex < len(arr):
        if arr[currentindex] < arr[minindex]:
            minindex = currentindex
        currentindex += 1
    return minindex

def optimize(inital_crv, t):
    crv = copy.deepcopy(inital_crv)
    length = len(crv) #length of curves list
    num = 0 #count
    while num < length-1:
        li_dis = []
        t1 = rs.CurveDomain(crv[num])[1]
        front_end_pt = rs.EvaluateCurve(crv[num], t1)
        #next_start_pt
        for i in range(num+1, length, 1):
            t0 = rs.CurveDomain(crv[i])[0]
            next_start_pt = rs.EvaluateCurve(crv[i], t0)
            dis = rs.Distance(front_end_pt, next_start_pt)
            li_dis.append(dis)
            if dis <= t: break
        closet_index = indexofMin(li_dis)+num+1
        crv[num+1], crv[closet_index] = crv[closet_index], crv[num+1]
        num += 1
    return crv

def calculate_empty_road_length(crv):
    start_pts = []
    end_pts = []
    empty_lines = []
    empty_len = 0
    for i in range(len(crv) - 1):
        start_pt = rs.CurveStartPoint(crv[i + 1])
        end_pt = rs.CurveEndPoint(crv[i - 1])
        empty_line = rs.AddLine(end_pt, start_pt)
        empty_len += rs.CurveLength(empty_line)
        empty_lines.append(empty_line)
    return empty_lines, empty_len


iter = 1

# get inital length
inital_empty_len = calculate_empty_road_length(crv)[1]
max_t = int(inital_empty_len // len(crv)) # get max t

# optimization by iteration and comparision
min_t = 0
empty_lens = []
record_t = []
range_t = [(i / iter * max_t) for i in range(iter)]
for t in range_t:
    record_t.append(t)
    opti_crv = optimize(crv, t)
    opti_empty_len = calculate_empty_road_length(opti_crv)[1]
    empty_lens.append(opti_empty_len)
    if len(empty_lens) > 1:
        if empty_lens[-2] < empty_lens[-1]:
            empty_lens[-2], empty_lens[-1] = empty_lens[-1], empty_lens[-2]
            record_t[-2], record_t[-1] = record_t[-1], record_t[-2]
opti_t = record_t[-1]

# optimize
opti_crv = optimize(crv, opti_t)
opti_empty_len = calculate_empty_road_length(opti_crv)[1]

# output
opti_curve = opti_crv
#empty_len = [inital_empty_len, opti_empty_len]
#empty_line = calculate_empty_road_length(opti_crv)[0]
# ---------- end local_road_optimization ----------
crv_2 = Curve(local_road_optimization.opti_curve)
optimial_curve = ClusterOutput(crv_2)  # Optimial curve as list

# ==== cluster GlobalPathOptimization: Global path optimization by combination Genetic Algorithm and Greedy Algorithm
input_curve = ClusterInput()  # Input curve as list
min_iteration = ClusterInput()  # Min iteration
int = Integer(min_iteration)
crv = Curve(input_curve)
global_road_optimization = GlobalRoadOptimization(crv=crv, min_iter=int)  # -> out, opti_curve, min_distance, iter_step; inputs crv: list, min_iter: Int32
# ---------- global_road_optimization: Python ----------
import rhinoscriptsyntax as rs
import random


def create_bool(crv):
    if crv is not None:
        bools = []
        for i in range(len(crv)):
            b = random.randint(0,1)
            bools.append(b)
        return bools

def reverse_crv(crv, bools):
    if crv is not None:
        for i in range(len(crv)):
            if bools[i] == 1:
                rs.ReverseCurve(crv[i])

def list_shift(list, s):
    if s > 0:
        for i in range(s):
            list.insert(len(list), list[0])
            list.pop(0)

def indexofMin(arr):
    minindex = 0
    currentindex = 1
    while currentindex < len(arr):
        if arr[currentindex] < arr[minindex]:
            minindex = currentindex
        currentindex += 1
    return minindex

def greedy(crv, t):
    length = len(crv) #length of curves list
    num = 0 #count
    while num < length-1:
        li_dis = []
        t1 = rs.CurveDomain(crv[num])[1]
        front_end_pt = rs.EvaluateCurve(crv[num], t1)
        #next_start_pt
        for i in range(num+1, length, 1):
            t0 = rs.CurveDomain(crv[i])[0]
            next_start_pt = rs.EvaluateCurve(crv[i], t0)
            dis = rs.Distance(front_end_pt, next_start_pt)
            li_dis.append(dis)
            if dis <= t: break
        closet_index = indexofMin(li_dis)+num+1
        crv[num+1], crv[closet_index] = crv[closet_index], crv[num+1]
        num += 1

def road_length(crv):
    dis = 0
    for i in range(len(crv)-1):
        start_pt = rs.CurveStartPoint(crv[i+1])
        end_pt = rs.CurveEndPoint(crv[i])
        distance = rs.Distance(end_pt, start_pt)
        dis += distance
    return dis

def sort_index(list):
    return sorted(range(len(list)), key = lambda k: list[k], reverse =False)

def resort(list, key):
    ltmp = []
    for i in range(len(key)):
        ltmp.append(list[key[i]])
    list[:] = ltmp[:]

def nature_section(count = 50, section_rate = 1.4, section = 25):
    d = section_rate #the more value is higher, the more rate select good grades
    n = section #reserve how many species
    m = (1-d**n)/(1-d) #sum of geometric progression
    per = []
    tmp = 0
    per.append(tmp)
    for i in range(n-1, -1, -1):
        p = d**i/m #The probability of being selected
        tmp += p
        per.append(tmp)
    
    sectionOfIndex = []
    for i in range(count):
        r = random.random()
        for j in range(n):
            if r >= per[j] and r < per[j+1]:
                sectionOfIndex.append(j)
    return sectionOfIndex

def copy_list(list):
    new_list = list[:]
    return new_list

def gradient(list, num):
    difference = []
    for i in range(1, num, 1):
        front = list[-i-1]
        next = list[-i]
        dif = front - next
        difference.append(dif)
    return max(difference)


if min_iter is None:
    min_iter = 35

#generic alogrithm loop
m = 50 #the count of species
iter = 0 #iteration
min_dis = [] #cloest distance list
k = 1 #diffrence value between two cloest distance
xx = 10

bools = []
shifts = []
tols = []
dis = []
crv2 = rs.CopyObjects(crv)
#generate the first DNA
for i in range(m):
    bool = create_bool(crv2)
    shift = int((len(crv2) -1)*random.random())
    tol = random.randint(0,100)*0.01*20
    bools.append(bool)
    shifts.append(shift)
    tols.append(tol)

while iter < min_iter + 50 and k > 0:
    if iter < 1: #first loop, construct the first generation
        #optimize road
        for i in range(m):
            reverse_crv(crv2, bools[i])
            list_shift(crv2, shifts[i])
            greedy(crv2, tols[i])
            distance = road_length(crv2)
            dis.append(distance)
            crv2 = rs.CopyObjects(crv)
    else:
        dis = []
        bools[:] = child_bools[:]
        shifts[:] = child_shifts[:]
        tols[:] = child_tols[:]
        #optimize road
        for i in range(m):
            reverse_crv(crv2, bools[i])
            list_shift(crv2, shifts[i])
            greedy(crv2, tols[i])
            distance = road_length(crv2)
            dis.append(distance)
            crv2 = rs.CopyObjects(crv)
    #sort
    min_dis.append(min(dis))
    key = sort_index(dis)
    resort(bools, key)
    resort(shifts, key)
    resort(tols, key)
    ns = nature_section(m, 1.2, m//2) #generate index of nature section
    #next generation
    child_bools = []
    child_shifts = []
    child_tols = []
    child_bools.append(bools[0])
    child_shifts.append(shifts[0])
    child_tols.append(tols[0])
    father_bool = []
    mother_bool = []
    for i in range(m-1-xx):
        father_bool[:] = bools[ns[i]]
        mother_bool[:] = bools[ns[i+1]]
        mid = len(father_bool)//3
        father_bool[mid:] = mother_bool[mid:]
        child_bools.append(father_bool)
        child_shifts.append(shifts[ns[i]])
        child_tols.append(tols[ns[i]])
    for i in range(xx):
        mu_bool = create_bool(crv2)
        mu_shift = int((len(crv2) -1)*random.random())
        mu_tol = random.randint(0,100)*0.01*20
        child_bools.append(mu_bool)
        child_shifts.append(mu_shift)
        child_tols.append(mu_tol)
    iter += 1
    if iter >= min_iter:
        k = gradient(min_dis, min_iter)

#output best DNA
reverse_crv(crv2, bools[0])
list_shift(crv2, shifts[0])
greedy(crv2, tols[0])

opti_curve = crv2
min_distance = [min_dis[0], min_dis[-1]]
iter_step = iter
# ---------- end global_road_optimization ----------
int_2 = Integer(global_road_optimization.iter_step)
num = Number(global_road_optimization.min_distance)
crv_2 = Curve(global_road_optimization.opti_curve)
optimial_curve = ClusterOutput(crv_2)  # Optimial curve as list
iteration = ClusterOutput(int_2)  # Real iteration
min_length = ClusterOutput(num)  # Min length of the empty walk

# ==== cluster ProcessVisualization: Printing process visualization from 0 to 1
printing_process = ClusterInput()  # Printing process from 0 to 1
input_curve = ClusterInput()  # Input curve as list
crv = Curve(input_curve)
num = Number(printing_process)
road_visualization = RoadVisualization(crv=flatten(crv), rate=num)  # -> out, a, b; inputs crv: list of Curve
# ---------- road_visualization: Python ----------
import rhinoscriptsyntax as rs

if accuracy is None: accuracy = 0.3
if accuracy == 0: accuracy = 0.1
pts = []
for i in range(len(crv)):
    crv_pts = rs.DivideCurveLength(crv[i], accuracy)
    end_pt = rs.CurveEndPoint(crv[i])
    pts.extend(crv_pts)
    if crv_pts[-1] != end_pt:
        pts.append(end_pt)



tmp = []
length = int(len(pts)*rate)
if length > 1:
    for k in range(length):
        tmp.append(pts[k])
    a = rs.AddPolyline(tmp)
    nozzle_plane = rs.CreatePlane(tmp[-1],
                                  rs.CreateVector(1,0,0),
                                  rs.CreateVector(0,1,0))
    b = rs.AddCone(nozzle_plane, 5.0, 5.0, cap=True)
# ---------- end road_visualization ----------
brep = Brep(road_visualization.b)
crv_2 = Curve(road_visualization.a)
nozzle = ClusterOutput(brep)  # Visualization of the nozzle
visual_curve = ClusterOutput(crv_2)  # Visualization of the printing path

# ==== cluster PrintPreview: Show printed result with volume
input_curve = ClusterInput()  # Input curve as list
printing_width = ClusterInput()  # Printing width
printing_height = ClusterInput()  # Printing height
num = Number(printing_width)
num_2 = Number(printing_height)
crv = Curve(flatten(input_curve))
len = Length(Curve=crv)
cls = Closed(Curve=crv)  # -> Closed, Periodic
divide = DivideCurve(Curve=crv, Count=len, Kinks=False)  # -> Points, Tangents, Parameters
tstat = TreeStatistics(Tree=divide.Tangents)  # -> Paths, Length, Count
tstat_2 = TreeStatistics(Tree=divide.Points)  # -> Paths, Length, Count
dispatch = Dispatch(List=tstat_2.Paths, DispatchPattern=cls.Closed)  # -> ListA, ListB
dispatch_2 = Dispatch(List=tstat.Paths, DispatchPattern=cls.Closed)  # -> ListA, ListB
branch = TreeBranch(Tree=divide.Points, Path=dispatch.ListB, MaintainPaths=True)
branch_2 = TreeBranch(Tree=divide.Points, Path=dispatch.ListA, MaintainPaths=True)
branch_3 = TreeBranch(Tree=divide.Tangents, Path=dispatch_2.ListB, MaintainPaths=True)
branch_4 = TreeBranch(Tree=divide.Tangents, Path=dispatch_2.ListA, MaintainPaths=True)
item = ListItem(List=branch_2, Index="0", Wrap=True)
item_2 = ListItem(List=branch_4, Index="0", Wrap=True)
merge = Merge(Data1=branch_2, Data2=item)
merge_2 = Merge(Data1=branch_4, Data2=item_2)
merge_3 = Merge(Data1=merge, Data2=branch)
merge_4 = Merge(Data1=merge_2, Data2=branch_3)
Z = UnitZ(Factor=1)
division = Division(A=num, B="2")
xprod = CrossProduct(VectorA=merge_4, VectorB=Z, Unitize=True)  # -> Vector, Length
neg = Negative(Value=division)
pl = ConstructPlane(Origin=merge_3, XAxis=xprod.Vector, YAxis=Z)
dom = ConstructDomain(DomainStart=division, DomainEnd=neg)
rectangle = Rectangle(Plane=pl, XSize=dom, YSize=num_2, Radius=0)  # -> Rectangle, Length
merge_5 = Merge(Data1=rectangle.Rectangle)
cull_i = CullIndex(List=merge_5, Indices="-1", Wrap=True)
cull_i_2 = CullIndex(List=merge_5, Indices="0", Wrap=True)
disc = Discontinuity(Curve=cull_i, Level=1)  # -> Points, Parameters
item_3 = ListItem(List=merge_5, Index=0, Wrap=True)
disc_2 = Discontinuity(Curve=cull_i_2, Level=1)  # -> Points, Parameters
item_4 = ListItem(List=merge_5, Index="-1", Wrap=True)
shift = ShiftList(List=disc_2.Points, Shift=1, Wrap=True)
shift_2 = ShiftList(List=disc.Points, Shift=1, Wrap=True)
disc_3 = Discontinuity(Curve=item_4, Level=1)  # -> Points, Parameters
graft = GraftTree(Tree=disc.Points, IncludeEmptyLists=True, IncludeNullItems=True)
graft_2 = GraftTree(Tree=shift_2, IncludeEmptyLists=True, IncludeNullItems=True)
graft_3 = GraftTree(Tree=disc_2.Points, IncludeEmptyLists=True, IncludeNullItems=True)
graft_4 = GraftTree(Tree=shift, IncludeEmptyLists=True, IncludeNullItems=True)
disc_4 = Discontinuity(Curve=item_3, Level=1)  # -> Points, Parameters
weave = Weave(Pattern=[0, 1], Stream0=graft_4, Stream1=graft_3, NullGaps=False)  # -> simplify(Weave)
weave_2 = Weave(Pattern=[0, 1], Stream0=graft, Stream1=graft_2, NullGaps=False)  # -> simplify(Weave)
merge_6 = Merge(Data1=weave_2, Data2=weave)
conmesh = ConstructMesh(Vertices=disc_4.Points, Faces={A=0, B=1, C=2, D=3})  # -> simplify(Mesh)
conmesh_2 = ConstructMesh(Vertices=disc_3.Points, Faces={A=0, B=1, C=2, D=3})  # -> simplify(Mesh)
conmesh_3 = ConstructMesh(Vertices=merge_6, Faces={A=0, B=1, C=2, D=3})
trim = TrimTree(Tree=conmesh_3, Depth="2")
merge_7 = Merge(Data1=conmesh_2, Data2=trim, Data3=conmesh)
mjoin = MeshJoin(Meshes=merge_7)  # -> flatten(Mesh)
mjoin_2 = MeshJoin(Meshes=mjoin)
demesh = DeconstructMesh(Mesh=mjoin_2)  # -> Vertices, Faces, Colours, Normals
pdecon = Deconstruct(Point=demesh.Vertices)  # -> XComponent, YComponent, ZComponent
sort = SortList(Keys=pdecon.ZComponent)  # -> Keys, ValuesA
bnd = Bounds(Numbers=sort.Keys)
dedomain = DeconstructDomain(Domain=bnd)  # -> Start, End
gradient = Gradient(
    LowerLimit=dedomain.End,
    UpperLimit=dedomain.Start,
    Parameter=pdecon.ZComponent,
    stops=[0.15: RGB(255, 130, 160), 0.85: RGB(220, 0, 40)])
conmesh_4 = ConstructMesh(Vertices=demesh.Vertices, Faces=demesh.Faces, Colours=gradient)  # -> flatten(Mesh)
M = ClusterOutput(conmesh_4)

# ==== cluster FillCrossPath: Fill cross-line from input region
region = ClusterInput()  # Planar closed curve
rotate_cross_line = ClusterInput()  # Rotate cross-line
cross_line_angle = ClusterInput()  # Cross-line angle
cross_line_gap = ClusterInput()  # Cross-line gap
cross_line_height = ClusterInput()  # Cross-line height
printing_layer = ClusterInput()  # Printing layer count
crv = Curve(region)
num = Number(rotate_cross_line)
num_2 = Number(cross_line_angle)
num_3 = Number(cross_line_gap)
num_4 = Number(cross_line_height)
int = Integer(printing_layer)
python = GhPythonScript(region=crv, Rotate=num, Angle=num_2, Gap=num_3, Height=num_4, Layer=int)  # -> out, CrossLine, LayerCount; inputs region: Curve, Layer: Int32
# ---------- python: Python ----------
__author__ = "littlechao PC"
__version__ = "2023.08.25"

import rhinoscriptsyntax as rs
import Rhino.Geometry as rg
import math

# convert curve into polyline
def curve_to_pts(region):
    if not rs.IsPolyline(region):
        seg_count = int(rg.Curve.GetLength(region))
        poly_pts = rs.DivideCurve(region, seg_count, create_points=False, return_points=True)
        poly_pts.append(poly_pts[0])
    else:
        poly_pts = rs.PolylineVertices(region)
    return poly_pts


# compute normal of the line
def line_to_normal(sPt, ePt):
    nX = sPt.Y - ePt.Y
    nY = ePt.X - sPt.X
    return rs.CreateVector(nX, nY, sPt.Z)

# is intersection
def is_intersection(sPt1, ePt1, sPt2, ePt2):
    n1 = line_to_normal(sPt1, ePt1)
    judge_dist_n1 = (sPt1.X * n1.X) + (sPt1.Y * n1.Y)
    dist_sPt2_n1 = (sPt2.X * n1.X) + (sPt2.Y * n1.Y)
    dist_ePt2_n1 = (ePt2.X * n1.X) + (ePt2.Y * n1.Y)
    val1 = (dist_sPt2_n1 - judge_dist_n1) * (dist_ePt2_n1 - judge_dist_n1)
    
    n2 = line_to_normal(sPt2, ePt2)
    judge_dist_n2 = (sPt2.X * n2.X) + (sPt2.Y * n2.Y)
    dist_sPt1_n2 = (sPt1.X * n2.X) + (sPt1.Y * n2.Y)
    dist_ePt1_n2 = (ePt1.X * n2.X) + (ePt1.Y * n2.Y)
    val2 = (dist_sPt1_n2 - judge_dist_n2) * (dist_ePt1_n2 - judge_dist_n2)
    
    if val1 <= 0.0 and val2 <= 0.0:
        return True
    else: return False

# compute cross point
def compute_cross_pt(sPt1, ePt1, sPt2, ePt2):
    points = rs.LineLineIntersection(rs.AddLine(sPt1, ePt1), rs.AddLine(sPt2, ePt2))
    return points[0]

# compute average point
def get_center(pts):
    cx = 0.0
    cy = 0.0
    cz = 0.0
    for pt in pts:
        cx += pt.X
        cy += pt.Y
        cz += pt.Z
    return rs.AddPoint(cx/len(pts), cy/len(pts), cz/len(pts))



def generate_cross_lines(poly_pts, R, Gap):
    # compute bounding region
    plane = rs.CreatePlane(get_center(poly_pts), rs.CreateVector(1,0,0), rs.CreateVector(0,1,0))
    plane = rs.RotatePlane(plane, R, rs.CreateVector(0,0,1))
    Bpts = rs.BoundingBox(poly_pts, plane, True)
    
    # divide lines
    seg_count = int(rs.Distance(Bpts[0], Bpts[3]) / Gap)
    seg_sPts1 = rs.DivideCurve(rs.AddLine(Bpts[0], Bpts[3]), seg_count, create_points=False, return_points=True)
    seg_ePts1 = rs.DivideCurve(rs.AddLine(Bpts[1], Bpts[2]), seg_count, create_points=False, return_points=True)
    
    seg_sPts2 = rs.DivideCurve(rs.AddLine(Bpts[0], Bpts[1]), seg_count, create_points=False, return_points=True)
    seg_ePts2 = rs.DivideCurve(rs.AddLine(Bpts[3], Bpts[2]), seg_count, create_points=False, return_points=True)
    
    # compute cross point and generate interior polylines
    inter_lines = []
    for i in range(seg_count + 1):
        if i % 2 == 0:
            # compute cross point
            cross_Pts = dict()
            for j in range(len(poly_pts) - 1):
                if is_intersection(seg_sPts1[i], seg_ePts1[i], poly_pts[j], poly_pts[j+1]):
                    cross_pt = compute_cross_pt(seg_sPts1[i], seg_ePts1[i], poly_pts[j], poly_pts[j+1])
                    dist = rs.Distance(seg_sPts1[i], cross_pt)
                    cross_Pts[dist] = cross_pt
            if len(cross_Pts) > 1:
                cross_Pts = sorted(cross_Pts.items(), key=lambda x: x[0])
                if len(cross_Pts) % 2 == 0:
                    for k in range(0, len(cross_Pts), 2):
                        inter_lines.append(rs.AddLine(cross_Pts[k][1], cross_Pts[k+1][1]))
                else:
                    for k in range(1, len(cross_Pts), 2):
                        inter_lines.append(rs.AddLine(cross_Pts[k][1], cross_Pts[k+1][1]))
        
        if i % 2 == 1:
            # compute cross point
            cross_Pts = dict()
            for j in range(len(poly_pts) - 1):
                if is_intersection(seg_ePts1[i], seg_sPts1[i], poly_pts[j], poly_pts[j+1]):
                    cross_pt = compute_cross_pt(seg_ePts1[i], seg_sPts1[i], poly_pts[j], poly_pts[j+1])
                    dist = rs.Distance(seg_ePts1[i], cross_pt)
                    cross_Pts[dist] = cross_pt
            if len(cross_Pts) > 1:
                cross_Pts = sorted(cross_Pts.items(), key=lambda x: x[0])
                if len(cross_Pts) % 2 == 0:
                    for k in range(0, len(cross_Pts), 2):
                        inter_lines.append(rs.AddLine(cross_Pts[k][1], cross_Pts[k+1][1]))
                else:
                    for k in range(1, len(cross_Pts), 2):
                        inter_lines.append(rs.AddLine(cross_Pts[k][1], cross_Pts[k+1][1]))
    
    # clear lines with too short length
    clean_lines = []
    for i in range(len(inter_lines)):
        if rs.CurveLength(inter_lines[i]) > 0.1:
            clean_lines.append(inter_lines[i])
    return clean_lines





if Rotate is None: Rotate = 0
if Angle is None: Angle = 90
if Gap is None: Gap = 0.2
if Height is None: Height = 0.2
if Layer is None: Layer = 1

if region is None:
    pass
else:
    multi_cross_lines = []
    layer_count = []
    poly_pts = curve_to_pts(region)
    for i in range(Layer):
        moved_points = []
        for pt in poly_pts:
            moved_points.append(rg.Point3d(pt.X, pt.Y, pt.Z + i*Height))
        moved_polyline = rs.AddPolyline(moved_points)
        multi_cross_lines.append(moved_polyline)
        cross_lines = generate_cross_lines(moved_points, Rotate + i * Angle, Gap)
        multi_cross_lines.extend(cross_lines)
        layer_count.append(len(cross_lines)+1)
    
    CrossLine = multi_cross_lines
    LayerCount = layer_count
# ---------- end python ----------
crv_2 = Curve(python.CrossLine)
int_2 = Integer(python.LayerCount)
cross_line = ClusterOutput(crv_2)  # Output cross-line
layer_count = ClusterOutput(int_2)  # Count of the cross-line per layer
